# Grasshopper definition 03_the_great_repair_Berlin_design.ghx (Grasshopper 1.0.7)
# plug-ins: Weaverbird

reload = Button()
py = PythonScript(reload=reload)
# ---------- py: Python ----------
from compas_rhino.utilities.misc import get_tolerance
from compas_ghpython import unload_modules

unload_modules("ur_fabrication_control")
unload_modules("assembly_information_model")
unload_modules("humocap")
# ---------- end py ----------

py_2 = PythonScript()  # -> HERE, DATA
# ---------- py_2: Python ----------
import os

HERE = os.path.dirname(ghdoc.Path)
DATA = os.path.abspath(os.path.join(HERE, "..", "data"))
print(HERE)
print(DATA)
# ---------- end py_2 ----------

# ----
# Element
# Predefine a brick element and its dimensions
# Visualise the defined element
show = BooleanToggle(False)
elem_def = GhPythonScript()  # -> out, elem_full, elem_half
# ---------- elem_def: Python ----------
import os
import sys
import json

from compas.geometry import Frame
from compas.geometry import Vector
from compas.geometry import Box

from assembly_information_model.assembly import Element


# dimensions full brick
width = 0.115
length = 0.240
height = 0.052

elem_full = Element.from_dimensions(width, length, height)
elem_full.tool_frame = Frame([0, 0, height], [1, 0, 0], [0, -1, 0])

elem_half = Element.from_dimensions(length/2, width, height)
elem_half.tool_frame = Frame([0, 0, height], [1, 0, 0], [0, -1, 0])
# ---------- end elem_def ----------
draw = PythonScript(elem_full=elem_def.elem_full, elem_half=elem_def.elem_half, show=show)  # -> M, F, S
# ---------- draw: Python ----------
from compas.geometry import Transformation
from compas.geometry import Frame
from compas.datastructures import mesh_transformed
from compas_ghpython.artists import MeshArtist
from compas_ghpython import draw_frame

if show:
    M = [Artist(elem_full.mesh).draw]
    F = [draw_frame(elem_full.frame)]
    #S = [draw_frame(elem_full._source.frame)]
    S = [draw_frame(elem_full.tool_frame)]
    
    
    M += [Artist(elem_half.mesh).draw]
    F += [draw_frame(elem_half.frame)]
    #S += [draw_frame(elem_half._source.frame)]
    S = [draw_frame(elem_half.tool_frame)]
# ---------- end draw ----------

# ----
# Assembly
layer_3b = Brep([<brep referenced from the Rhino model> x20])
layer_3a = Brep([<brep referenced from the Rhino model> x21])
layer_5b = Brep([<brep referenced from the Rhino model> x20])
layer_0b = Brep([<brep referenced from the Rhino model> x21])
layer_1b = Brep([<brep referenced from the Rhino model> x20])
layer_2a = Brep([<brep referenced from the Rhino model> x22])
layer_4b = Brep([<brep referenced from the Rhino model> x21])
layer_4a = Brep([<brep referenced from the Rhino model> x21])
layer_6c = Brep([<brep referenced from the Rhino model> x21])
layer_6a = Brep([<brep referenced from the Rhino model> x16])
layer_0a = Brep([<brep referenced from the Rhino model> x21])
layer_1a = Brep([<brep referenced from the Rhino model> x21])
layer_2b = Brep([<brep referenced from the Rhino model> x20])
layer_5a = Brep([<brep referenced from the Rhino model> x21])
layer_6b = Brep([<brep referenced from the Rhino model> x15])
merge = Merge(
    Data1=layer_0b,
    Data2=layer_0a,
    Data3=layer_1b,
    Data4=layer_1a,
    Data5=layer_2b,
    Data6=layer_2a,
    Data7=layer_3b,
    Data8=layer_3a,
    Data9=layer_4b,
    Data10=layer_4a,
    Data11=layer_5b,
    Data12=layer_5a,
    Data13=layer_6c,
    Data14=layer_6b,
    Data15=layer_6a)
debrep = DeconstructBrep(Brep=merge)  # -> Faces, Edges, Vertices
boxprop = BoxProperties(Box=merge)  # -> Center, Diagonal, Area, Volume, Degeneracy
item = ListItem(List=debrep.Edges, Index=0, Wrap=True)
pl = ConstructPlane(Origin=boxprop.Center, XAxis=flatten(item), YAxis=Vector(0, 1, 0))
generate_assembly = GhPythonScript(planes=pl, elem_full=elem_def.elem_full)  # -> assembly; inputs planes: list of Plane
# ---------- generate_assembly: Python ----------
import Rhino.Geometry as rg
import math
from scriptcontext import sticky as st


from compas.geometry import Frame
from compas.geometry import Transformation
from compas.geometry import Rotation
from compas.geometry import Translation
from compas.geometry import Point

from assembly_information_model.assembly import Assembly

import Rhino.Geometry as rg


assembly = Assembly() # initialize an empty assembly class

for plane in planes:
    plane.Translate(plane.ZAxis*-0.026)
    plane.Rotate(math.radians(90), plane.ZAxis)
    T = Transformation.from_frame_to_frame(Frame.worldXY(), Frame(plane.Origin, plane.XAxis, plane.YAxis))
    e = elem_full.transformed(T)
    assembly.add_element(e)
# ---------- end generate_assembly ----------

show_2 = BooleanToggle(True)
update_network = PythonScript(DATA=py_2.DATA, compute_interfaces_numpy=show_2, assembly=generate_assembly)  # -> assembly
# ---------- update_network: Python ----------
from assembly_information_model.assembly.courses import assembly_courses, assembly_with_interfaces_courses


if compute_interfaces_numpy:
    import os
    from compas.rpc import Proxy
    from assembly_information_model.assembly import Assembly
    p = Proxy('assembly_information_model.assembly.interfaces_numpy')
    p.stop_server()
    p.start_server()

    filename_before = "brickbench_ex1.json"
    filename_after = "brickbench_interfaces_ex1.json"

    PATH_BEFORE = os.path.join(DATA, filename_before)
    PATH_AFTER = os.path.join(DATA, filename_after)
    
    # the assembly has to be serialized such that it can be called from CPython
    assembly.to_json(PATH_BEFORE)
    
    # call the CPython Function using COMPAS RPC
    p.assembly_interfaces_numpy_fromtojson(PATH_BEFORE, PATH_AFTER, nmax=20, amin = 0.0001)
    #p.assembly_interfaces_numpy_fromtojson(PATH_BEFORE, PATH_AFTER, nmax=10, tmax=0.001, amin=0.001, lmin=1e-3, face_face=True, face_edge=False, face_vertex=False)

    assembly = Assembly.from_json(PATH_AFTER)


# now compute the courses
assembly_courses(assembly)

# example test: get the bottom keys
#c_min = min(assembly.network.nodes_attribute(name='course'))
#print(c_min)
#keys_on_bottom = list(assembly.network.nodes_where({'course': c_min}))
#print(keys_on_bottom)

# example test: get the top keys
#c_max = max(assembly.network.nodes_attribute(name='course'))
#print(c_max)
#keys_on_top = list(assembly.network.nodes_where({'course': c_max}))
#print(keys_on_top)
# ---------- end update_network ----------

# ----
# to JSON
export = Button()
export_2 = PythonScript(DATA=py_2.DATA, assembly=update_network, export_to_json=export)
# ---------- export_2: Python ----------
import os
from compas.datastructures.mesh import mesh_quads_to_triangles
from compas.datastructures.mesh import mesh_unify_cycles

if export_to_json:
    
    filename = "brickbench_final_berlin.json"
    PATH = os.path.join(DATA, filename)
    
    # the assembly has to be serialized such that it can be called from CPython
    assembly.to_json(PATH)
# ---------- end export_2 ----------

key = Slider(100, range=0..388)
till_key = Button()
reset = Button()
back = Button()
start = Button()
stop = Button()
step = Button()
full = Button()
list = ValueList({"20", "50", "100", "500", "1000", "5000"}, selected="50")

python = GhPythonScript(assembly=generate_assembly, brickweight="3.2")  # -> out
# ---------- python: Python ----------
total = assembly.network.number_of_nodes()

print "Total number of bricks:", total
print "Total weight of brick bench:", total*brickweight, "kg"
# ---------- end python ----------

# ----
# Draw
# Visualise the entire assembly and its underlying network topology.
counter = CountThroughList(
    assembly=generate_assembly,
    start=start,
    stop=stop,
    step=step,
    step_back=back,
    reset=reset,
    full=full,
    till_key=till_key,
    key=key,
    interval=list)  # -> item, counter; inputs start: Boolean, stop: Boolean, step_back: Boolean, key: Int32
# ---------- counter: Python ----------
from scriptcontext import sticky as st
from compas_ghpython import update_component


L = list(assembly.elements())
# store data in component
guid = str(ghenv.Component.InstanceGuid)
counter_key = "counter_" + guid
running_key = "running_" + guid

if counter_key not in st:
    st[counter_key] = 0

if running_key not in st:
    st[running_key] = False
    

if st[running_key]:
    if st[counter_key] < len(L) - 1:
        st[counter_key] += 1
        update_component(ghenv, interval)
    else:
        st[counter_key] = 0
        st[running_key] = False
    
    
if start:
    st[running_key] = True

if stop:
    st[running_key] = False

if step:
    if st[counter_key] < len(L) - 1:
        st[counter_key] += 1

if step_back:
    if st[counter_key] < len(L):
        st[counter_key] -= 1

if reset:
    st[counter_key] = 0

if till_key:
    st[counter_key] = key

if full:
    st[counter_key] = len(L)-1

if len(L):
    item = L[st[counter_key]]



#st["visualisation_counter"] = st[counter_key]
#st[counter_key]= 500
counter = st[counter_key]
# ---------- end counter ----------
idx = Panel(counter.counter)

# ---- group: Assembly Artist
show_3 = BooleanToggle(False)
show_4 = BooleanToggle(True)
draw_2 = PythonScript(assembly=update_network, show_all=show_3, show_counter=show_4, counter=counter.counter)  # -> G, tool_planes_WCS, current_tool_plane; inputs counter: Int32
# ---------- draw_2: Python ----------
import os
import sys

import math
from compas.artists import Artist
from compas.colors import Color


G = []

key_index = assembly.network.key_index()
keys = [key_index[key] for key in assembly.network.nodes()]
elements = [assembly.element(key) for key in keys]
#print elements
#print([(e.gripping_frame) for e in elements])

tool_planes_WCS = [Artist(e.tool_frame).draw() for e in elements]

current_tool_plane = tool_planes_WCS[counter]

if show_all and not show_counter:
    for element in elements:
        mesh = Artist(element.mesh).draw(Color(1.,0.8,0.65,1.))
        G.append(mesh)

if show_counter:
    for element in elements[0:counter+1]:
        mesh = Artist(element.mesh).draw(Color(1.,0.8,0.65,1.))
        G.append(mesh)
# ---------- end draw_2 ----------
geo = Geometry(draw_2.G)
pln = Plane(draw_2.tool_planes_WCS)
pln_2 = Plane(draw_2.current_tool_plane)
wbtriangles = WeaverbirdsSplitTrianglesSubdivision(MeshCurves=geo, Level=1)
preview = CustomPreview(Geometry=pln, Shader=ColourSwatch(SwatchColor=RGB(178, 178, 178)))
preview_2 = CustomPreview(Geometry=wbtriangles, Shader=ColourSwatch(SwatchColor=RGBA(255, 255, 255, 157)))

# ----
panel = Panel(python)

# ----
# Network visualization
number_slider = Slider(0, range=0..47)
show_5 = BooleanToggle(True)
network_viz = GhPythonScript(assembly=update_network, show_network=show_5, key=number_slider)  # -> out, nodes, edges, current_node, current_node_neighbors; inputs key: Int32
# ---------- network_viz: Python ----------
import sys, os
import ghpythonlib.components as ghcomp
from compas.datastructures import Network
from compas_ghpython.artists import NetworkArtist
from compas_rhino.geometry import RhinoLine

import compas_ghpython
import Rhino.Geometry as rg


data = assembly.network.to_data()
network = Network.from_data(data)

print assembly.network.number_of_nodes()

def draw_network(network):
    """Draw a network in Grasshopper.
    """
    points = []
    for key, attr in network.nodes(True):
        points.append({
            'pos': network.node_coordinates(key),
        })

    lines = []
    for (u, v), attr in network.edges(True):
        lines.append({
            'start': network.node_coordinates(u),
            'end': network.node_coordinates(v),
        })

    points_rg = compas_ghpython.draw_points(points)
    lines_rg = compas_ghpython.draw_lines(lines)

    return points_rg, lines_rg

if show_network:
    nodes, edges = draw_network(network)
    
    current_node = {'pos': network.node_coordinates(key), 'radius': 0.03}
    current_node = compas_ghpython.draw_spheres([current_node])
    
    current_node_neighbors_keys = network.neighbors(key)
    current_node_neighbors = [{'pos': network.node_coordinates(key), 'radius': 0.02} for key in current_node_neighbors_keys]
    current_node_neighbors = compas_ghpython.draw_spheres(current_node_neighbors)
# ---------- end network_viz ----------
pt = Point(network_viz.nodes)
line = Line(network_viz.edges)
brep = Brep(network_viz.current_node)
brep_2 = Brep(network_viz.current_node_neighbors)
preview_3 = CustomPreview(Geometry=brep_2, Material=ColourSwatch(SwatchColor=RGB(255, 207, 207)))
preview_4 = CustomPreview(Geometry=[brep, line], Material=ColourSwatch(SwatchColor=RGB(0, 0, 0)))
