# Grasshopper definition 04_the_great_repair_Berlin_fabrication_no_lift.ghx (Grasshopper 1.0.7)
# plug-ins: Weaverbird

reload = Button()
panel = Panel("Unload libraries")
py = PythonScript(reload=reload)
# ---------- py: Python ----------
from compas_rhino.utilities.misc import get_tolerance
from compas_ghpython import unload_modules

unload_modules("ur_fabrication_control")
unload_modules("fabrication_manager")
unload_modules("assembly_information_model")
unload_modules("mobile_robot_control")
unload_modules("humocap")
# ---------- end py ----------

py_2 = PythonScript()  # -> HERE, DATA
# ---------- py_2: Python ----------
import os

HERE = os.path.dirname(ghdoc.Path)
DATA = os.path.abspath(os.path.join(HERE, "..", "data"))
print(HERE)
print(DATA)
# ---------- end py_2 ----------

# ----
# Element
# Predefine a brick element and its dimensions
# Visualise the defined element
show = BooleanToggle(False)
elem_def = GhPythonScript()  # -> out, elem_full, elem_half
# ---------- elem_def: Python ----------
import os
import sys
import json

from compas.geometry import Frame
from compas.geometry import Vector
from compas.geometry import Box

from assembly_information_model.assembly import Element


# dimensions full brick
width = 0.115
length = 0.240
height = 0.052

elem_full = Element.from_dimensions(length, width, height)
elem_full.tool_frame = Frame([0, 0, height], [1, 0, 0], [0, -1, 0])

elem_half = Element.from_dimensions(length/2, width, height)
elem_half.tool_frame = Frame([0, 0, height], [1, 0, 0], [0, -1, 0])
# ---------- end elem_def ----------
draw = PythonScript(elem_full=elem_def.elem_full, elem_half=elem_def.elem_half, show=show)  # -> M, F, S
# ---------- draw: Python ----------
from compas.geometry import Transformation
from compas.geometry import Frame
from compas.datastructures import mesh_transformed
from compas_ghpython.artists import MeshArtist
from compas_ghpython import draw_frame

if show:
    M = [Artist(elem_full.mesh).draw]
    F = [draw_frame(elem_full.frame)]
    #S = [draw_frame(elem_full._source.frame)]
    S = [draw_frame(elem_full.tool_frame)]
    
    
    M += [Artist(elem_half.mesh).draw]
    F += [draw_frame(elem_half.frame)]
    #S += [draw_frame(elem_half._source.frame)]
    S = [draw_frame(elem_half.tool_frame)]
# ---------- end draw ----------

# ----
# ROS client
panel_2 = Panel("9090")
list = ValueList({"local": "127.0.0.1", "linux computer": "192.168.0.42", "linux eduroam": "10.181.95.254", "robot": "192.168.0.200"}, selected="local")
connect = BooleanToggle(True)
ros = ROSConnect(ip=list, port=panel_2, connect=connect)  # -> ros_client, is_connected; inputs port: Int32, connect: Boolean
#   port ip: The ip address ROS. Defaults to 127.0.0.1.
#   port port: The port of ROS. Defaults to 9090.
#   port connect: If True, connects to ROS. If False, disconnects from ROS. Defaults to False.
#   port ros_client: The ROS client.
#   port is_connected: True if connection established.
# ---------- ros: Python ----------
"""
Connect or disconnect to ROS.

COMPAS FAB v0.27.0
"""
from ghpythonlib.componentbase import executingcomponent as component
from scriptcontext import sticky as st

from compas_fab.backends import RosClient
from compas_fab.ghpython.components import create_id


class ROSConnect(component):
    def RunScript(self, ip, port, connect):
        ros_client = None

        ip = ip or '127.0.0.1'
        port = port or 9090

        key = create_id(self, 'ros_client')
        ros_client = st.get(key, None)

        if ros_client:
            st[key].close()
        if connect:
            st[key] = RosClient(ip, port)
            st[key].run(5)

        ros_client = st.get(key, None)
        is_connected = ros_client.is_connected if ros_client else False
        return (ros_client, is_connected)
# ---------- end ros ----------
panel_3 = Panel(ros.is_connected)

# ----
# IP Settings
# --> Set your IP address
# --> Set robot IP address
server_ip = ValueList({"192.168.0.42", "127.0.0.1", "192.168.10.111", "192.168.0.250", "192.168.0.30", "10.42.0.212", "10.42.0.133"}, selected="192.168.0.42")
ext_ip = ValueList({"192.168.10.10", "192.168.10.20", "192.168.10.11", "192.168.10.12", "127.0.0.1", "192.168.10.111", "192.168.0.220", "192.168.0.30", "192.168.10.50", "0.0.0.0"}, selected="192.168.0.220")
ur_ip = ValueList({"192.168.10.10", "192.168.10.20", "192.168.10.11", "192.168.10.12", "127.0.0.1", "192.168.10.111", "192.168.0.210", "192.168.0.211", "192.168.0.30"}, selected="192.168.0.211")
server_port = ValueList({"50002", "50003", "50005", "50006", "50007", "50008", "50009", "50010", "50011", "50012", "50013", "50014", "50015", "50016", "50017", "50018", "50019", "50020", "50021", "50022", "50023", "50024", "50025", "50026", "50027", "50028"}, selected="50009")
ext_port = ValueList({"50003", "50004"}, selected="50004")
ur_port = ValueList({"30002"}, selected="30002")
globals = PythonScript(
    server_ip=server_ip,
    server_port=server_port,
    ur_ip=ur_ip,
    ur_port=ur_port,
    ext_ip=ext_ip,
    ext_port=ext_port,
    clear=Button())  # inputs server_port: Int32
# ---------- globals: Python ----------
from scriptcontext import sticky as st

st["server_ip"] = server_ip
st["server_port"] = server_port

st["ur_ip"] = ur_ip
st["ur_port"] = ur_port

st["ext_ip"] = ext_ip
st["ext_port"] = ext_port


if clear:
    st.clear()
# ---------- end globals ----------

# ----
# Check if UR robot
#  is available
ping = Button()
py_3 = PythonScript(ip=ur_ip, ping=ping)  # -> out, trigger
# ---------- py_3: Python ----------
from scriptcontext import sticky as st
from ur_fabrication_control.direct_control.utilities import is_available

guid = str(ghenv.Component.InstanceGuid)
txt_key = "txt_" + guid
if txt_key not in st:
    st[txt_key] = ""

if ping:
    
    available = is_available(ip)
    
    if available:
        st[txt_key] = "%s is up!" % ip
        trigger = True
    else:
        st[txt_key] = "%s is down!" % ip
        trigger = False

print(st[txt_key])
# ---------- end py_3 ----------
panel_4 = Panel(py_3.out)

# ----
# Load robot from ROS
# Load robot from ROS
load = Button()
robot = ROSRobot(ros_client=ros.ros_client, load=load)  # -> mobile_robot; inputs load: Boolean
#   port ros_client: The ROS client.
#   port load: If True, loads the robot from ROS. Defaults to False.
# ---------- robot: Python ----------
"""
Load robot directly from ROS.

COMPAS FAB v0.27.0
"""
from mobile_robot_control.mobile_robot import MobileRobot
from mobile_robot_control.mobile_robot_client import MobileRobotClient

from compas_ghpython.artists import RobotModelArtist
from ghpythonlib.componentbase import executingcomponent as component
from scriptcontext import sticky as st

from compas_fab.ghpython.components import create_id


class ROSRobot(component):
    def RunScript(self, ros_client, prefix, load):
        key = create_id(self, 'robot')

        if ros_client and ros_client.is_connected and load:
            # Load URDF from ROS
            robot = ros_client.load_robot(
                    load_geometry=True, 
                    urdf_param_name= '{}/robot_description'.format(prefix),
                    srdf_param_name= '{}/robot_description_semantic'.format(prefix),
                    precision='12f')
            robot.artist = RobotModelArtist(robot.model)
            mobile_robot = MobileRobot(robot.model, robot.artist, robot.semantics, client=None, wheel_type="indoor")
            st[key] = mobile_robot

        mobile_robot = st.get(key, None)
        if mobile_robot:  # client sometimes need to be restarted, without needing to reload geometry
            mobile_robot.mobile_client = MobileRobotClient(ros_client)
            mobile_robot.client = ros_client
        return mobile_robot
# ---------- end robot ----------

# ----
# Load assembly
# Import assembly from .json.
list_2 = ValueList({"Design model": 0, "Fabrication model": 1, "Assembly model": 2}, selected="Design model")
import = Button(ExpressionNormal="True", ExpressionPressed="False")
initial_assembly = GhPythonScript(DATA=py_2.DATA, assembly_preset=list_2, import_from_json=import)  # -> out, assembly; inputs import_from_json: Boolean
# ---------- initial_assembly: Python ----------
import os
import json
from scriptcontext import sticky

from assembly_information_model.assembly import Assembly

if import_from_json:
    if assembly_preset == 0:
        filename = "brickbench_final_berlin.json"
    elif assembly_preset == 1:
        filename = "brickbench_final.json"
    else:
        filename = "study_1e.json"
        
    PATH = os.path.join(DATA, filename)
    assembly = Assembly.from_json(PATH)
    assembly.support_keys = []
# ---------- end initial_assembly ----------

key = Slider(63, range=0..388)
till_key = Button()
reset = Button()
start = Button()
back = Button()
stop = Button()
step = Button()
full = Button()
list_3 = ValueList({"20", "50", "100", "500", "1000", "5000"}, selected="50")

show_2 = BooleanToggle(True)
python = GhPythonScript(assembly=initial_assembly.assembly, brickweight="3.2")  # -> out
# ---------- python: Python ----------
total = assembly.network.number_of_nodes()

print "Total number of bricks:", total
print "Total weight of brick bench:", total*brickweight, "kg"
# ---------- end python ----------
bcf_wcs_0 = Plane(Plane(origin=(0.08620849868, 0.02112257488, 0), x=(0.9396926208, 0.3420201433, 0), y=(-0.3420201433, 0.9396926208, 0)))
bcf_wcs_1 = Plane(Plane(origin=(-0.08620849868, 0.02112257488, 0), x=(-0.9396926208, 0.3420201433, 0), y=(-0.3420201433, -0.9396926208, 0)))
bcf_wcs_2 = Plane(Plane(origin=(0, 0, 0), x=(0, 1, 0), y=(-1, 0, 0)))

# ----
# Draw
# Visualise the entire assembly and its underlying network topology.
counter = CountThroughList(
    assembly=initial_assembly.assembly,
    start=start,
    stop=stop,
    step=step,
    step_back=back,
    reset=reset,
    full=full,
    till_key=till_key,
    key=key,
    interval=list_3)  # -> item, counter; inputs start: Boolean, stop: Boolean, step_back: Boolean, key: Int32
# ---------- counter: Python ----------
from scriptcontext import sticky as st
from compas_ghpython import update_component


L = list(assembly.elements())
# store data in component
guid = str(ghenv.Component.InstanceGuid)
counter_key = "counter_" + guid
running_key = "running_" + guid

if counter_key not in st:
    st[counter_key] = 0

if running_key not in st:
    st[running_key] = False
    

if st[running_key]:
    if st[counter_key] < len(L) - 1:
        st[counter_key] += 1
        update_component(ghenv, interval)
    else:
        st[counter_key] = 0
        st[running_key] = False
    
    
if start:
    st[running_key] = True

if stop:
    st[running_key] = False

if step:
    if st[counter_key] < len(L) - 1:
        st[counter_key] += 1

if step_back:
    if st[counter_key] < len(L):
        st[counter_key] -= 1

if reset:
    st[counter_key] = 0

if till_key:
    st[counter_key] = key

if full:
    st[counter_key] = len(L)-1

if len(L):
    item = L[st[counter_key]]



#st["visualisation_counter"] = st[counter_key]
#st[counter_key]= 500
counter = st[counter_key]
# ---------- end counter ----------
idx = Panel(counter.counter)

# ---- group: Assembly Artist
show_3 = BooleanToggle(True)
show_4 = BooleanToggle(False)
draw_2 = PythonScript(assembly=initial_assembly.assembly, show_all=show_4, show_counter=show_3, show_keys=show_2, counter=counter.counter)  # -> G, tool_planes_WCS, current_tool_plane, key_tag_location, key_tag_text; inputs counter: Int32
# ---------- draw_2: Python ----------
import os
import sys

import math
from compas.artists import Artist
from compas.colors import Color


G = []
key_tag_text = []
key_tag_location= []

key_index = assembly.network.key_index()
keys = [key_index[key] for key in assembly.network.nodes()]
elements = [assembly.element(key) for key in keys]
#print elements
#print([(e.gripping_frame) for e in elements])

tool_planes_WCS = [Artist(e.tool_frame).draw() for e in elements]

current_tool_plane = tool_planes_WCS[counter]

if show_all and not show_counter:
    for element in elements:
        mesh = Artist(element.mesh).draw(Color(1.,0.8,0.65,1.))
        G.append(mesh)

if show_counter:
    for element in elements[0:counter+1]:
        mesh = Artist(element.mesh).draw(Color(1.,0.8,0.65,1.))
        G.append(mesh)

if show_keys:
    for key, element in assembly.elements():
        if show_counter and key < counter:
            key_tag_text.append(str(key))
            key_tag_location.append(Artist(element.frame).draw().Origin)
        elif show_all:
            key_tag_text.append(str(key))
            key_tag_location.append(Artist(element.frame).draw().Origin)
# ---------- end draw_2 ----------
pln = Plane(draw_2.current_tool_plane)
geo = Geometry(draw_2.G)
pln_2 = Plane(draw_2.tool_planes_WCS)
tag = TextTag(Location=draw_2.key_tag_location, Text=draw_2.key_tag_text)
wbtriangles = WeaverbirdsSplitTrianglesSubdivision(MeshCurves=geo, Level=1)
preview = CustomPreview(Geometry=wbtriangles, Shader=ColourSwatch(SwatchColor=RGBA(255, 255, 255, 157)))
preview_2 = CustomPreview(Geometry=pln_2, Shader=ColourSwatch(SwatchColor=RGB(178, 178, 178)))

# ----
panel_5 = Panel(python)
# Configuration
l = Slider(0.0056, range=0..0.72)
select_configuration = Slider(2, range=0..7)

# ----
# Network visualization
number_slider = Slider(0, range=0..47)
show_5 = BooleanToggle(False)
network_viz = GhPythonScript(assembly=initial_assembly.assembly, show_network=show_5, key=number_slider)  # -> out, nodes, edges, current_node, current_node_neighbors; inputs key: Int32
# ---------- network_viz: Python ----------
import sys, os
import ghpythonlib.components as ghcomp
from compas.datastructures import Network
from compas_ghpython.artists import NetworkArtist
from compas_rhino.geometry import RhinoLine

import compas_ghpython
import Rhino.Geometry as rg


data = assembly.network.to_data()
network = Network.from_data(data)

print assembly.network.number_of_nodes()

def draw_network(network):
    """Draw a network in Grasshopper.
    """
    points = []
    for key, attr in network.nodes(True):
        points.append({
            'pos': network.node_coordinates(key),
        })

    lines = []
    for (u, v), attr in network.edges(True):
        lines.append({
            'start': network.node_coordinates(u),
            'end': network.node_coordinates(v),
        })

    points_rg = compas_ghpython.draw_points(points)
    lines_rg = compas_ghpython.draw_lines(lines)

    return points_rg, lines_rg

if show_network:
    nodes, edges = draw_network(network)
    
    current_node = {'pos': network.node_coordinates(key), 'radius': 0.03}
    current_node = compas_ghpython.draw_spheres([current_node])
    
    current_node_neighbors_keys = network.neighbors(key)
    current_node_neighbors = [{'pos': network.node_coordinates(key), 'radius': 0.02} for key in current_node_neighbors_keys]
    current_node_neighbors = compas_ghpython.draw_spheres(current_node_neighbors)
# ---------- end network_viz ----------
pt = Point(network_viz.nodes)
line = Line(network_viz.edges)
brep = Brep(network_viz.current_node)
brep_2 = Brep(network_viz.current_node_neighbors)
preview_3 = CustomPreview(Geometry=brep_2, Material=ColourSwatch(SwatchColor=RGB(255, 207, 207)))
preview_4 = CustomPreview(Geometry=[brep, line], Material=ColourSwatch(SwatchColor=RGB(0, 0, 0)))

python_2 = GhPythonScript(assembly=initial_assembly.assembly, show_patches=Toggle(True))  # -> out, all_keys_below_patch_1, G_patch_1, G_patch_2, G_patch_3
# ---------- python_2: Python ----------
import rhinoscriptsyntax as rs

from compas.geometry import Point, Vector
from compas.artists import Artist
from compas.colors import Color


G_patch_1 = []
G_patch_2 = []
G_patch_3 = []

key_index = assembly.network.key_index()
keys = [key_index[key] for key in assembly.network.nodes()]
elements = [assembly.element(key) for key in keys]

def get_neighbors_below(key):
    """
    get the direct neighbors below one chosen element
    """
    neighbors_below = []
    neighbors = assembly.network.neighbors(key)
    for n in neighbors:
        if assembly.element(n).frame.point.z < assembly.element(key).frame.point.z:
            neighbors_below.append(n)
    return neighbors_below

def get_neighbors_above(key):
    """
    get the direct neighbors above one chosen element
    """
    neighbors_above = []
    neighbors = assembly.network.neighbors(key)
    for n in neighbors:
        if assembly.element(n).frame.point.z > assembly.element(key).frame.point.z:
            neighbors_above.append(n)
    return neighbors_above

def get_all_neighbors_below_1(key, all_keys_below_1=[]):
    """
    recursive function to get all neighbors below one chosen element
    """
    neighbors_below = get_neighbors_below(key)
    if len(neighbors_below):
        for n in neighbors_below:
            if n not in all_keys_below_1:
                all_keys_below_1.append(n)
                get_all_neighbors_below_1(n, all_keys_below_1)
    return all_keys_below_1
    
def get_all_neighbors_below_2(key, all_keys_below_2=[]):
    """
    recursive function to get all neighbors below one chosen element
    """
    neighbors_below = get_neighbors_below(key)
    if len(neighbors_below):
        for n in neighbors_below:
            if n not in all_keys_below_2:
                all_keys_below_2.append(n)
                get_all_neighbors_below_2(n, all_keys_below_2)
    return all_keys_below_2

#def get_one_neighbor_below(key):
#    """
#    get one neighbor below one chosen element
#    """
#    neighbors_below = get_neighbors_below(key)
#    return neighbors_below[0]


def get_all_neighbors_above(key, all_keys_above=[]):
    """
    recursive function to get all neighbors above one chosen element
    """
    neighbors_above = get_neighbors_above(key)
    if len(neighbors_above):
        for n in neighbors_above:
            all_keys_above.append(n)
            get_all_neighbors_above(n, all_keys_above)
    return all_keys_above

def find_element_closest_to_point(point):
    """
    find the element closest to the point input
    """
    min_dist = 100.
    min_key = 0
    for key, element in assembly.elements():
        dist = (element.frame.point-point).length # calc distance from point input to element frame
        if dist < min_dist:
            min_dist = dist
            min_key = key
    return min_key
    
    
# get the element closest to the point 
keys_patch_1 = [289,288, 287, 286, 250, 251,252, 283, 253, 254]
#keys_patch_1 = [288, 250]
keys_patch_2 = [298, 299, 300, 301, 271, 270, 269, 268, 267, 266, 274]

keys_below_patch_1 = []
keys_below_patch_2 = []

# get all elements below the chosen element
for key_p1 in keys_patch_1:
    keys_below_patch_1 += get_all_neighbors_below_1(key_p1)
    
for key_p2 in keys_patch_2:
    keys_below_patch_2 += get_all_neighbors_below_2(key_p2)

print len(keys_below_patch_1)
print len(keys_below_patch_2)

# set node attribute of all chosen keys as support
all_keys_below_patch_1 = keys_patch_1 + keys_below_patch_1
all_keys_below_patch_2 = keys_patch_2 + keys_below_patch_2

all_keys_below_patch_1.sort()
all_keys_below_patch_2.sort()

print all_keys_below_patch_1
print all_keys_below_patch_2
print len(all_keys_below_patch_1)
print len(all_keys_below_patch_2)

keys_patch_1_and_2 = all_keys_below_patch_1 + all_keys_below_patch_2
all_keys_below_patch_3 = [key for key in keys if key not in keys_patch_1_and_2]

print "Patch 1:", len(all_keys_below_patch_1), "bricks"
print "Patch 2:", len(all_keys_below_patch_2), "bricks"
print "Patch 3:", len(all_keys_below_patch_3), "bricks"

elements_patch_1 = [assembly.element(key) for key in all_keys_below_patch_1] 
elements_patch_2 = [assembly.element(key) for key in all_keys_below_patch_2] 
elements_patch_3 = [assembly.element(key) for key in all_keys_below_patch_3] 

if show_patches:
    for element in elements_patch_1:
        geo_patch_1 = Artist(element.mesh).draw(Color(0.0, 1.0, 0.0, 1.0))
        G_patch_1.append(geo_patch_1)
        
    for element in elements_patch_2:
        geo_patch_2 = Artist(element.mesh).draw(Color(1.0, 0.0, 0.0, 1.0))
        G_patch_2.append(geo_patch_2)

    for element in elements_patch_3:
        geo_patch_3 = Artist(element.mesh).draw(Color(0.0, 0.0, 1.0, 1.0))
        G_patch_3.append(geo_patch_3)
# ---------- end python_2 ----------
mesh = Mesh(python_2.G_patch_3)  # disabled
mesh_2 = Mesh(python_2.G_patch_2)  # disabled
mesh_3 = Mesh(python_2.G_patch_1)  # disabled
panel_6 = Panel(python_2.all_keys_below_patch_1)
configuration = Slider(14, range=-1..50)
show_robot_frame = BooleanToggle(False)
button = Button()
button_2 = Button()
button_3 = Button()

# ----
# Stop
stop_2 = Button()
stop_3 = PythonScript(stop=stop_2)
# ---------- stop_3: Python ----------
from scriptcontext import sticky as st
from ur_fabrication_control.direct_control.common import send_stop

ur_ip = st["ur_ip"]
ur_port = st["ur_port"]

if stop:
    send_stop(ur_ip, ur_port)
# ---------- end stop_3 ----------

list_4 = ValueList({"placing": 0, "releasing": 1, "place one": 2, "place safe": 3}, selected="releasing")

# ----
# Area Gripper Switch
suction = BooleanToggle(False)
blow_off = BooleanToggle(False)
digital_out = PythonScript(suction=suction, blow_off=blow_off)  # -> urscript
# ---------- digital_out: Python ----------
from ur_fabrication_control.direct_control import URScript
from ur_fabrication_control.direct_control.mixins import AreaGripMixins

class URScript_AreaGrip(URScript, AreaGripMixins):
    pass

urscript = URScript_AreaGrip()
urscript.start()

if suction == True and blow_off == False:
    urscript.areagrip_on()
elif blow_off == True:
    urscript.areagrip_blowoff()
elif suction == False and blow_off == False:
    urscript.areagrip_off()

urscript.end()
urscript = urscript.generate()
print(urscript)
# ---------- end digital_out ----------
send = Button()
send_2 = GhPythonScript(urscript=digital_out, send=send)  # -> out; inputs send: Boolean
# ---------- send_2: Python ----------
from scriptcontext import sticky as st
from ur_fabrication_control.direct_control import send_script

ur_ip = st["ur_ip"]
ur_port = st["ur_port"]

if send:
    send_script(urscript, ur_ip, ur_port)
# ---------- end send_2 ----------

# ----
# Stop
stop_4 = Button()
stop_5 = PythonScript(stop=stop_4)  # same code as stop_3

x_axis = Curve(<curve referenced from the Rhino model>)
y_axis = Curve(<curve referenced from the Rhino model>)
aa_est = PythonScript(plane_axes=[x_axis, y_axis])  # -> plane; inputs plane_axes: list of Curve
# ---------- aa_est: Python ----------
import Rhino.Geometry as rg

x_axis, y_axis = plane_axes

x_axis = rg.Line(x_axis.PointAtStart, x_axis.PointAtEnd)
y_axis = rg.Line(y_axis.PointAtStart, y_axis.PointAtEnd)

if x_axis.From.DistanceTo(y_axis.From) < 0.01:
    origin = x_axis.From
    xvec = x_axis.Direction
    yvec = y_axis.Direction
elif x_axis.To.DistanceTo(y_axis.To) < 0.01:
    origin = x_axis.To
    xvec = -x_axis.Direction
    yvec = -y_axis.Direction
elif x_axis.From.DistanceTo(y_axis.To) < 0.01:
    origin = x_axis.From
    xvec = x_axis.Direction
    yvec = -y_axis.Direction
elif x_axis.To.DistanceTo(y_axis.From) < 0.01:
    origin = x_axis.To
    xvec = -x_axis.Direction
    yvec = y_axis.Direction

plane = rg.Plane(origin, xvec, yvec)
# ---------- end aa_est ----------
pln_3 = Plane(aa_est)

# ----
# Step
number_slider_2 = Slider(3, range=0..100)  # disabled
python_3 = PythonScript(key=number_slider_2)  # -> out, element, M; inputs key: Int32; disabled
# ---------- python_3: Python ----------
from compas.artists import Artist


element = assembly.element(key)

M = Artist(element.mesh).draw()
# ---------- end python_3 ----------
element = Data(python_3.element)  # disabled
colour_swatch = ColourSwatch(SwatchColor=RGBA(255, 0, 0, 218))  # disabled
preview_5 = CustomPreview(Geometry=python_3.M, Shader=colour_swatch)  # disabled

counter_2 = Integer(counter.counter)

# ----
# Store configurations
add = Button()
add_configs = GhPythonScript(assembly=initial_assembly.assembly, counter=counter_2, add=add)  # -> assembly; inputs configurations: list, planes: list
# ---------- add_configs: Python ----------
__author__ = "lidet"
__version__ = "2023.06.13"

import rhinoscriptsyntax as rs
from compas.geometry import Frame
from compas_fab.robots import Configuration

if add:
    assembly.element(counter).trajectory = configurations
    assembly.element(counter).path = [Frame(plane.Origin, plane.XAxis, plane.YAxis) for plane in planes]
# ---------- end add_configs ----------
get_configs = GhPythonScript(assembly=add_configs, counter=counter_2)  # -> out, configurations, planes
# ---------- get_configs: Python ----------
import rhinoscriptsyntax as rs
from compas_ghpython import draw_frame
from compas_fab.robots import Configuration

configurations = assembly.element(counter).trajectory
planes = [draw_frame(frame) for frame in assembly.element(counter).path]

print configurations

#configs = assembly.element(counter).
# ---------- end get_configs ----------
pln_4 = Plane(get_configs.planes)
pline = PolyLine(Vertices=pln_4, Closed=False)

# ---- group: cartesian motion
# 6. Save assembly to json
panel_7 = Panel("assembly_stack_planned.json")  # disabled
save = Button()  # disabled
python_4 = PythonScript(name=panel_7, save=save)  # -> out, a; disabled
# ---------- python_4: Python ----------
import os
filename = os.path.join(DATA, name)

print assembly.element(0)

if save:
    assembly.to_json(filename, pretty=True)
# ---------- end python_4 ----------

# ----
# 6. Load from planned assembly
panel_8 = Panel("00_the_great_repair_plan_paths_assembly.json")
python_5 = GhPythonScript(data_path=py_2.DATA, filename=panel_8, read=Toggle(False), upto=Slider(3, range=0..20))  # -> out, assembly, configurations; inputs upto: Int32
# ---------- python_5: Python ----------
import os
from assembly_information_model.assembly import Assembly

filepath = os.path.join(data_path, filename)

if os.path.isfile(filepath):
    assembly = Assembly.from_json(filepath)
    configurations = []
    #for key in assembly.network.nodes():
    for key in range(upto):
        element = assembly.element(key)
        if element.trajectory:
            trajectory_points = []
            for trajectory in element.trajectory:
                trajectory_points += trajectory.points
            configurations += trajectory_points
            trajectory_points.reverse()
            configurations += trajectory_points
# ---------- end python_5 ----------

# ----
# to JSON
panel_9 = Panel("assembly.json")
export = Button()
export_2 = Button()
export_3 = PythonScript(DATA=py_2.DATA, assembly=add_configs, filename=panel_9, export_to_json=export_2, export_to_json_unity=export)
# ---------- export_3: Python ----------
import os

if export_to_json:
    PATH = os.path.join(DATA, filename)
    # the assembly has to be serialized such that it can be called from CPython
    assembly.to_json(PATH, pretty=True)
# ---------- end export_3 ----------

python_6 = PythonScript()  # -> out; inputs key: Int32; disabled
# ---------- python_6: Python ----------
if trajectory1 and trajectory2 and trajectory3:
    element = assembly.element(key)
    element.trajectory = trajectory1.points + trajectory2.points + trajectory3.points
    assembly.network.node_attribute(key, 'is_planned', True)
# ---------- end python_6 ----------
python_7 = PythonScript()  # -> trajectory; inputs trajectory1: list, trajectory2: list, trajectory3: list
# ---------- python_7: Python ----------
trajectory = []

if trajectory1 != [None]:
    trajectory += trajectory1

if trajectory2 != [None]:
    trajectory += trajectory2

if trajectory3 != [None]:
    trajectory += trajectory3
# ---------- end python_7 ----------
start_2 = Button()  # disabled
stop_6 = Button()  # disabled
reset_2 = Button()  # disabled
stop_7 = Button()  # disabled
start_3 = Button()
stop_8 = Button()
step_2 = Button()
reset_3 = Button()
counter_3 = CountThroughList(start=start_2, stop=stop_6, step=False, back=stop_7, reset=reset_2, interval=1)  # -> item; inputs L: list, start: Boolean, stop: Boolean; disabled
# ---------- counter_3: Python ----------
from scriptcontext import sticky as st
from compas_ghpython.utilities import update_component

if not interval:
    interval = 5

# store data in component
guid = str(ghenv.Component.InstanceGuid)
counter_key = "counter_" + guid
running_key = "running_" + guid

if counter_key not in st or reset:
    st[counter_key] = 0

if running_key not in st:
    st[running_key] = False


    

if start:
    st[running_key] = True

if stop:
    st[running_key] = False

if step:
    if st[counter_key] < len(L) - 1:
        st[counter_key] += 1

if back:
    if st[counter_key] > 1:
        st[counter_key] -= 1

if len(L):
    item = L[st[counter_key]]

if st[running_key]:
    if st[counter_key] < len(L) - 1:
        st[counter_key] += 1
        update_component(ghenv, interval)
    else:
        st[counter_key] = 0
        st[running_key] = False
# ---------- end counter_3 ----------
counter_4 = CountThroughList(L=python_5.configurations, start=start_3, stop=stop_8, step=step_2, reset=reset_3, interval=1)  # -> item; inputs L: list, start: Boolean, stop: Boolean
# ---------- counter_4: Python ----------
from scriptcontext import sticky as st
from compas_ghpython.utilities import update_component

if not interval:
    interval = 10

# store data in component
guid = str(ghenv.Component.InstanceGuid)
counter_key = "counter_" + guid
running_key = "running_" + guid

if counter_key not in st:
    st[counter_key] = 0

if running_key not in st:
    st[running_key] = False

if start:
    st[running_key] = True

if stop:
    st[running_key] = False

if step:
    if st[counter_key] < len(L) - 1:
        st[counter_key] += 1

if back:
    if st[counter_key] > 1:
        st[counter_key] -= 1

if len(L):
    item = L[st[counter_key]]

if st[running_key]:
    if st[counter_key] < len(L) - 1:
        st[counter_key] += 1
        update_component(ghenv, interval)
    else:
        st[counter_key] = 0
        st[running_key] = False

if reset:
    st[counter_key] = 0
# ---------- end counter_4 ----------

# ----
# Attach tool
list_5 = ValueList({"measurement_tool": 0, "clay_extruder_7mm": 1, "area_gripper": 2, "area_gripper_435i": 3, "area_gripper_extended": 4}, selected="area_gripper_extended")
show_6 = BooleanToggle(True)
remove = Button()
py_4 = PythonScript()  # -> DATA
# ---------- py_4: Python ----------
import os

#package_path = os.path.dirname(mobile_fabrication_control.__file__)
#DATA = os.path.abspath(os.path.join(package_path,"../../data"))

package_path = ghdoc.Path
# package_path = os.path.dirname(ur_fabrication_control.__file__)
#DATA = os.path.abspath(os.path.join(package_path,"../../data"))

# .stl files not stored in am_hackathon repo. but in mobile_fabrication_control
DATA = os.path.abspath(os.path.join(package_path,"../../../mobile_robot_control/data"))

print(package_path)
print(DATA)
# ---------- end py_4 ----------
add_2 = Button()
tool = PythonScript(data_path=py_4, tool=list_5, show=show_6)  # -> tool, M, ee_plane
# ---------- tool: Python ----------
import os, math
from compas.geometry import Frame, Rotation
from compas.datastructures import Mesh
from compas_ghpython.artists import MeshArtist
from compas_fab.robots import Tool
from compas_ghpython.utilities import draw_frame

tolerance = 0

if tool == 0:
    filename = 'measurement_tool_zaxis.stl'
    ee_frame = Frame([0, 0, 0.109], [1, 0, 0], [0, 1, 0])

elif tool == 1:
    filename = 'clay_extruder_7mm.stl'
    # real frame:
    ee_frame = Frame([-0.000502, -0.105348, 0.0662,], [1, 0, 0], [0, 0, 1])
    
    # test frame:
    # ee_frame = Frame([0.0, 0.0, 0.1,], [1, 0, 0], [0, 1, 0])

elif tool == 2:
    filename = 'area_gripper_zaxis.stl'
    ee_frame = Frame([0, 0, 0.10219 + tolerance], [0, 1, 0], [-1, 0, 0])

elif tool == 3:
    filename = 'area_gripper_d435i_zaxis.stl'
    ee_frame = Frame([0, 0, 0.10219 + tolerance], [0, 1, 0], [-1, 0, 0])
#    ee_frame = Frame([0.054, 0, 0.065 + tolerance], [0, 1, 0], [-1, 0, 0])

elif tool == 4:
    filename = 'area_gripper_extended_55mm_simplified.stl'
    ee_frame = Frame([0, 0, 0.16219 + tolerance], [0, 1, 0], [-1, 0, 0])
#    ee_frame = Frame([0.054, 0, 0.065 + tolerance], [0, 1, 0], [-1, 0, 0])

data_path = os.path.join(data_path, "tool_geometry")
fullfilename = os.path.join(data_path, filename)
print fullfilename

ee_mesh = Mesh.from_stl(fullfilename)

if show:
    artist = MeshArtist(ee_mesh)
    M = artist.draw()

tool = Tool(ee_mesh, ee_frame)
ee_plane = draw_frame(ee_frame)
print(ee_frame.quaternion.xyzw)
ee_framek = Frame([0.0110607,0.00809854,0.41498], [0,1,0], [1,0,0])
print(ee_framek.quaternion.xyzw)
# ---------- end tool ----------
panel_10 = Panel("Attach a custom tool")
mesh_4 = Mesh(tool.M)
pln_5 = Plane(tool.ee_plane)
list_6 = ValueList({"ur10e", "ur10e_and_liftkit"}, selected="ur10e")
tool_2 = AttachedTool(robot=robot, visual_mesh=mesh_4, collision_mesh=mesh_4, tcf_plane=pln_5, group=list_6)  # -> robot; inputs visual_mesh: Mesh, collision_mesh: Mesh
#   port visual_mesh: A visual mesh for the tool.
#   port collision_mesh: A collision mesh for the tool.
#   port tcf_plane: The frame of the tool in tool0 frame.
#   port group: The planning group to which the tool should be attached.
# ---------- tool_2: Python ----------
"""
Attach a tool to the robot.

COMPAS FAB v0.27.0
"""
from ghpythonlib.componentbase import executingcomponent as component
from compas_rhino.conversions import RhinoMesh
from compas_rhino.conversions import plane_to_compas_frame

from compas.geometry import Frame
from compas_fab.robots import Tool


class AttachToolComponent(component):
    def RunScript(self, robot, visual_mesh, collision_mesh, tcf_plane, group):
        if robot and robot.client and robot.client.is_connected and visual_mesh:
            if not collision_mesh:
                collision_mesh = visual_mesh

            c_visual_mesh = RhinoMesh.from_geometry(visual_mesh).to_compas()
            c_collision_mesh = RhinoMesh.from_geometry(collision_mesh).to_compas()

            if not tcf_plane:
                frame = Frame.worldXY()
            else:
                frame = plane_to_compas_frame(tcf_plane)
            tool = Tool(c_visual_mesh, frame, c_collision_mesh)

            robot.attach_tool(tool, group)
            print tool.link_name

        return robot
# ---------- end tool_2 ----------

robot_2 = Data(tool_2)

# ----
# Planning scene
scene = PlanningScene(robot=robot_2)  # -> scene
#   port scene: A planning scene.
# ---------- scene: Python ----------
"""
Create a planning scene.

COMPAS FAB v0.27.0
"""
from ghpythonlib.componentbase import executingcomponent as component
from scriptcontext import sticky as st

from compas_fab.ghpython.components import create_id
from compas_fab.robots import PlanningScene


class PlanningSceneComponent(component):
    def RunScript(self, robot):
        key = create_id(self, 'planning_scene')
        if robot:
            st[key] = PlanningScene(robot)
            print key
        return st.get(key, None)
# ---------- end scene ----------

attach_remove = PythonScript(robot=robot_2, tool=tool.tool, attach=add_2, remove=remove)  # -> out, bang
# ---------- attach_remove: Python ----------
if attach:
    robot.attach_tool(tool)
if remove:
    robot.detach_tool()

print tool.link_name
# ---------- end attach_remove ----------

x_axis_2 = Curve(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)
y_axis_2 = Curve(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)
plane = PythonScript(plane_axes=[x_axis_2, y_axis_2])  # -> plane; inputs plane_axes: list of Curve; same code as aa_est
calc_bcf_wcs = GhPythonScript(robot=robot_2, RCF_WCS_plane=plane)  # -> out, BCF_WCS_plane
# ---------- calc_bcf_wcs: Python ----------
import rhinoscriptsyntax as rs
from compas_rhino.conversions import frame_to_rhino_plane, plane_to_compas_frame
from compas.geometry import Frame, Transformation


if robot:

    RCF_OCS_plane = frame_to_rhino_plane(robot.RCF) # TODO: RCF should move with BCF !!!! NEEDS TO BE CHECKED !!!!
    
    RCF_WCS = plane_to_compas_frame(RCF_WCS_plane)
    
    #print robot.RCF
    #print robot.BCF
    
    #Version A
    
    #RCF_RCS = RCF_WCS.transformed(robot.transformation_WCF_RCF())
    #BCF_WCS_A = RCF_RCS.transformed(robot.transformation_BCF_WCF())
    #
    #BCF_WCS_A_plane = frame_to_rhino_plane(BCF_WCS_A)
    #BCF_WCS_plane = BCF_WCS_A_plane
    
    #Version B
    
    T2 = Transformation.from_frame_to_frame(robot.RCF, RCF_WCS)
    print robot.RCF
    BCF_WCS_B = Frame.worldXY().transformed(T2)
    BCF_WCS_B_plane = frame_to_rhino_plane(BCF_WCS_B)
    
    BCF_WCS_plane = BCF_WCS_B_plane
# ---------- end calc_bcf_wcs ----------

# ----
# Attach to robot
remove_2 = Button()
add_3 = Button()
mesh_5 = Mesh(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)
acm = AttachedCollisionMesh(
    scene=scene,
    mesh=mesh_5,
    identifier="element",
    link_name="robot_arm_tool0",
    touch_links="robot_arm_tool0",
    add=add_3,
    remove=remove_2)  # -> attached_collision_mesh, bang; inputs mesh: Mesh, touch_links: list, add: Boolean, remove: Boolean
#   port scene: The planning scene.
#   port mesh: A collision mesh.
#   port identifier: The identifier of the collision mesh.
#   port link_name: The robot's link name to attach the mesh to.
#   port touch_links: Names of links that the robot is allowed to touch.
#   port add: If True, adds the collision mesh to the planning scene.
#   port remove: If True, removes the collision mesh from the planning scene.
#   port attached_collision_mesh: A collision mesh that is attached to a robot's link.
# ---------- acm: Python ----------
"""
Add an attached collision mesh to the robot.

COMPAS FAB v0.27.0
"""
from ghpythonlib.componentbase import executingcomponent as component

from compas_rhino.geometry import RhinoMesh
from compas_fab.robots import AttachedCollisionMesh
from compas_fab.robots import CollisionMesh

class AttachedCollisionMeshComponent(component):
    def RunScript(self, scene, mesh, identifier, link_name, touch_links, add, remove):
        attached_collision_mesh = None
        if scene and mesh and identifier and link_name:
            compas_mesh = RhinoMesh.from_geometry(mesh).to_compas()
            collision_mesh = CollisionMesh(compas_mesh, identifier)
            attached_collision_mesh = AttachedCollisionMesh(collision_mesh, link_name, touch_links)
            if add:
                scene.add_attached_collision_mesh(attached_collision_mesh)
            if remove:
                scene.remove_attached_collision_mesh(identifier)
                scene.remove_collision_mesh(identifier)
        return attached_collision_mesh
# ---------- end acm ----------

# ----
# Move mobile robot base
# Picking plane
angle = Slider(160, range=0..360)
base_origin = Point(Point(-0.04836777455, 0.0634951913, 0))
x_axis_3 = Curve(<curve referenced from the Rhino model>)
y_axis_3 = Curve(<curve referenced from the Rhino model>)
base_plane = GhPythonScript(origin=base_origin, angle=angle)  # -> base_plane; inputs origin: Point3d
# ---------- base_plane: Python ----------
import Rhino.Geometry as rg
import math

base_plane = rg.Plane(origin, rg.Vector3d.XAxis, rg.Vector3d.YAxis)
base_plane.Rotate(math.radians(angle), rg.Vector3d.ZAxis)
# ---------- end base_plane ----------
set_to_origin = BooleanToggle(False)
plane_2 = PythonScript(plane_axes=[x_axis_3, y_axis_3])  # -> plane; inputs plane_axes: list of Curve; same code as aa_est
set_base_frame = PythonScript(robot=robot_2, set_to_origin=set_to_origin, base_plane=bcf_wcs_0)  # -> bang, base_plane
# ---------- set_base_frame: Python ----------
from compas_ghpython import draw_frame
from compas.geometry import Frame, Point, Vector, Transformation
from compas.datastructures import Mesh
from compas_rhino.geometry import RhinoMesh
from compas_fab.robots import CollisionMesh

if set_to_origin:
    base_frame = Frame.worldXY()
else:
    base_frame = Frame(base_plane.Origin, base_plane.XAxis, base_plane.YAxis)


# Base_frame is BCF in WCF
if robot:
    robot.BCF = base_frame
    print(robot.BCF)
# ---------- end set_base_frame ----------
python_8 = GhPythonScript(robot=robot_2, picking_plane=plane_2)
# ---------- python_8: Python ----------
from compas.geometry import Frame

if robot and picking_plane:
    picking_frame = Frame(picking_plane.Origin, picking_plane.XAxis, picking_plane.YAxis)
    robot.PCF = picking_frame
# ---------- end python_8 ----------

# ----
# Attach to scene
remove_3 = Button()
add_4 = Button()
mesh_6 = Mesh(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)
cm = CollisionMesh(scene=scene, mesh=mesh_6, identifier="scene_elem", add=add_4, append=set_base_frame.bang, remove=remove_3)  # -> ok, bang; inputs mesh: Mesh, add: Boolean, append: Boolean, remove: Boolean
#   port scene: The planning scene.
#   port mesh: A collision mesh.
#   port identifier: The identifier of the collision mesh.
#   port add: If True, adds the collision mesh to the planning scene.
#   port append: If True, appends the collision mesh to the planning scene.
#   port remove: If True, removes the collision mesh from the planning scene.
#   port ok: True if the operation was successfully performed.
# ---------- cm: Python ----------
"""
Add or remove a collision mesh from the planning scene.

COMPAS FAB v0.27.0
"""
from compas_rhino.geometry import RhinoMesh
from ghpythonlib.componentbase import executingcomponent as component

from compas_fab.robots import CollisionMesh


class CollisionMeshComponent(component):
    def RunScript(self, scene, M, name, add, append, remove):
        ok = False
        self.Message = ""

        if (add and append) or (append and remove) or (add and remove):
            self.Message = "Use only one operation at a time\n(add, append or remove)"
            raise Exception(self.Message)

        if scene and M and name:
            mesh_WCS = RhinoMesh.from_geometry(M).to_compas()
            # transform to mobile robot base coordinate system
            mesh = mesh_WCS.transformed(scene.robot.transformation_WCF_BCF())
            collision_mesh = CollisionMesh(mesh, name)
            if add:
                scene.add_collision_mesh(collision_mesh)
                self.Message = "Added"
                ok = True
            if append:
                scene.append_collision_mesh(collision_mesh)
                self.Message = "Appended"
                ok = True
            if remove:
                scene.remove_collision_mesh(name)
                self.Message = "Removed"
                ok = True
        return ok
# ---------- end cm ----------
panel_11 = Panel(cm.ok)

info = PythonScript(robot=robot_2)  # -> out, main_group_name
# ---------- info: Python ----------
if robot:
    robot.info()
    main_group_name = robot.main_group_name
# ---------- end info ----------
panel_12 = Panel(info.out)

# ---- group: forward kinematics
a3 = Slider(11, range=-360..360)
a6 = Slider(90, range=-360..360)
a4 = Slider(0, range=-360..360)
a5 = Slider(0, range=-360..360)
a1 = Slider(0, range=-360..360)
a2 = Slider(0, range=-360..360)
jp = GhPythonScript()  # -> joint_positions
# ---------- jp: Python ----------
import math

joint_positions = [0,0,-90,90,0,90,0]
joint_positions = [math.radians(a) for a in joint_positions]
#joint_positions = [-3.136, -0.328, -1.218, 3.129, 0.852, 0.008]
#joint_positions = [0] * 6

#joint_positions =[0.000, 0.518, 0.046, 1.451, -3.088, -1.571, -1.236]


#joint_positions = [1.6239667567485938, 0.25439606475392273, 4.409424838594969-2*3.14, 3.1901607306255908, 1.5707963267948954, 0.053170429953696939]
#joint_positions = [1.598543436748912, 0.23021224965157744, 4.712232135219824-2*3.14, 6.0531299026928744, 4.7123889803846915, 0.027747109954015234]
#joint_positions = [-1.1373533430447322, 4.0117247163121572, 5.4083762087596021-2*3.14, 1.5754733624925168, 4.7123889803846879, 3.5750356373399574]
print joint_positions
# ---------- end jp ----------
forward_kinematics = PythonScript(robot=robot_2, set_joint_positions=Button(), joint_positions=jp, lift=l, a1=a1, a2=a2, a3=a3, a4=a4, a5=a5, a6=a6)  # -> full_configuration; inputs joint_positions: list
# ---------- forward_kinematics: Python ----------
import math
import Grasshopper
from compas.robots import Joint
from compas_fab.robots import Configuration

if set_joint_positions:
    j = 0
    for i in range(ghenv.Component.Params.Input.Count):
        nslider = ghenv.Component.Params.Input[i].Sources[0]
        if nslider.GetType() == Grasshopper.Kernel.Special.GH_NumberSlider:
            nslider.TrySetSliderValue(math.degrees(joint_positions[j]))
            j += 1

if robot:
    joints = robot.get_configurable_joints()
    joint_types = [joint.type for joint in joints]
    joint_names = [joint.name for joint in joints]
    
    joint_positions = [a1, a2, a3, a4, a5, a6]
    joint_positions = [math.radians(position) for position in joint_positions]
    
    if len(joints) == 7:
        joint_positions = [lift] + joint_positions
    
    print joint_types, joint_names, joint_positions
    full_configuration = Configuration(joint_positions, joint_types, joint_names)
    
print(full_configuration)
# ---------- end forward_kinematics ----------

# ---- group: zero configuration
zero_config = ZeroConfig(robot=robot_2)  # -> config
#   port group: If assigned, it will return the zero configuration for the given group, otherwise a full zero configuration.
#   port config: The zero configuration.
# ---------- zero_config: Python ----------
"""
Get a zero configuration for a robot.

COMPAS FAB v0.27.0
"""
from ghpythonlib.componentbase import executingcomponent as component


class ConfigZero(component):
    def RunScript(self, robot, group):

        if robot:
            return robot.zero_configuration(group)

        return None
# ---------- end zero_config ----------

# ---- group: current robot state
subscribe = Button()
unsubscribe = Button()
joint_states = GhPythonScript(robot=robot_2, subscribe=subscribe, unsubscribe=unsubscribe)
# ---------- joint_states: Python ----------
if subscribe:
    robot.mobile_client.joint_states_subscribe()

if unsubscribe:
    robot.mobile_client.joint_states_unsubscribe()

#robot.mobile_client.tf_subscribe("robot_arm_base", "robot_base_footprint")
#print('x')
# ---------- end joint_states ----------
trigger = Trigger(Interval=2000, TimerInterval=2000, Target=draw_3)
draw_3 = GhPythonScript(robot=robot_2)  # -> configuration
# ---------- draw_3: Python ----------
from compas_fab.robots import Configuration

configuration = robot.mobile_client.get_current_ur10e_and_liftkit_config()
print configuration
# ---------- end draw_3 ----------

# ----
# Fabrication Settings
list_7 = ValueList({"left": 0, "right": 1}, selected="left")
python_9 = GhPythonScript(robot=robot_2, approach_from=list_7, current_tool_plane=pln)  # -> out, picking_plane_RCF, approach_plane_WCF, picking_plane_safe_RCF, picking_frame_RCF, picking_frame_safe_RCF, picking_plane_WCF, picking_plane_safe_WCF, placing_plane_safe_WCF, placing_plane_WCF
# ---------- python_9: Python ----------
import math
from compas.geometry import Frame, Transformation
from compas_ghpython import draw_frame
from compas_fab.robots import Configuration
import Rhino.Geometry as rg

placing_tolerance = 0.0

if current_tool_plane:
    picking_frame_BCF = robot.PCF
    picking_frame_RCF = picking_frame_BCF.transformed(robot.transformation_BCF_RCF())
    picking_plane_RCF = draw_frame(picking_frame_RCF)
    picking_plane_RCF.Translate(rg.Vector3d.ZAxis*-0.005)
    picking_frame_RCF = Frame(picking_plane_RCF.Origin, picking_plane_RCF.XAxis, picking_plane_RCF.YAxis)
    #picking_plane_WCF.Translate(rg.Vector3d.ZAxis*0.05)

    placing_plane_WCF = current_tool_plane
    placing_plane_WCF.Translate(placing_plane_WCF.ZAxis*placing_tolerance)
    #placing_plane_WCF.Translate(placing_plane_WCF.ZAxis*-0.05)
    placing_plane_WCF.Rotate(math.radians(180), placing_plane_WCF.ZAxis, placing_plane_WCF.Origin)
    
    picking_plane_safe_RCF = rg.Plane(picking_plane_RCF)
    R = rg.Transform.Rotation(math.radians(5.0), picking_plane_RCF.XAxis, picking_plane_RCF.Origin)
    picking_plane_safe_RCF.Transform(R)
    picking_plane_safe_RCF.Translate(rg.Vector3d.ZAxis*0.4)
    picking_frame_safe_RCF = Frame(picking_plane_safe_RCF.Origin, picking_plane_safe_RCF.XAxis, picking_plane_safe_RCF.YAxis)
    
    placing_plane_safe_WCF = rg.Plane(placing_plane_WCF)
    placing_plane_safe_WCF.Translate(placing_plane_WCF.ZAxis*-0.2)
    
    move_plane_safe_WCF = rg.Plane(placing_plane_WCF)
    move_plane_safe_WCF.Translate(rg.Vector3d.ZAxis*0.30)
    
    # transform picking_frame_RCF and picking_frame_safe_RCF in WCF
    picking_frame_WCF = robot.from_BCF_to_WCF(robot.PCF)
    picking_frame_safe_BCF = picking_frame_safe_RCF.transformed(robot.transformation_RCF_BCF())
    picking_frame_safe_WCF = robot.from_BCF_to_WCF(picking_frame_safe_BCF)
    
    # visualize picking_frame_WCF and picking_frame_safe_WCF
    picking_plane_WCF = draw_frame(picking_frame_WCF)
    picking_plane_safe_WCF = draw_frame(picking_frame_safe_WCF)
    
    #picking_configuration = Configuration((0.000, -2.823, -1.812, 2.286, -2.045, -1.571, -0.466), (2, 0, 0, 0, 0, 0, 0))
    picking_configuration = Configuration((-2.823, -1.822, 2.273, -2.022, -1.571, -0.466), (0, 0, 0, 0, 0, 0))
    
    if approach_from == 0:
        #freemotion_start_config = Configuration((0.000, -1.257, -1.815, 2.286, -2.042, -1.571, 1.100), (2, 0, 0, 0, 0, 0, 0)) # rotate left (seen from top)
        freemotion_start_config = Configuration((0.000, -0.471, -1.815, 2.286, -2.042, -1.571, 1.885), (2, 0, 0, 0, 0, 0, 0))

    else:
        freemotion_start_config = Configuration((0.000,-3.613, -1.815, 2.286, -2.042, -1.571, -1.257), (2, 0, 0, 0, 0, 0, 0)) # rotate right (seen from top)
# ---------- end python_9 ----------
pln_6 = Plane(python_9.picking_plane_WCF)
pln_7 = Plane(python_9.placing_plane_safe_WCF)
pln_8 = Plane(python_9.picking_plane_safe_WCF)
pln_9 = Plane(python_9.placing_plane_WCF)
pln_10 = Plane(python_9.picking_plane_RCF)
pln_11 = Plane(python_9.approach_plane_WCF)
pln_12 = Plane(python_9.picking_plane_safe_RCF)

# ---- group: inverse kinematics
# approach_place_configuration
list_8 = ValueList({"picking_plane": 0, "picking_plane_safe": 1, "placing_plane_safe": 2, "placing_plane": 3}, selected="placing_plane_safe")
filter = StreamFilter(Gate=list_8, Stream0=pln_6, Stream1=pln_8, Stream2=pln_7, Stream3=pln_9)
analytic_inverse = PythonScript(robot=robot_2, lift=l, plane_WCS=filter, idx=select_configuration, bang=attach_remove.bang)  # -> out, full_configuration, configuration, plane_tool0_RCS, frame_RCS, frame_BCS, robot_frame, place_config_bool; inputs plane_WCS: Plane, idx: Int32, bang: list of Boolean
# ---------- analytic_inverse: Python ----------
import Rhino.Geometry as rg
import math
from compas.geometry import Frame, Transformation, Rotation
from compas_fab.robots import Configuration
from ur_fabrication_control.kinematics.ur_kinematics import inverse_kinematics
from ur_fabrication_control.kinematics.ur_params import ur_params
from compas_ghpython import draw_frame


if robot:
    robot.lift_height = lift
    
    frame_WCS = Frame(plane_WCS.Origin, plane_WCS.XAxis, plane_WCS.YAxis)
    
    # transform frame to robot coordinate system
    frame_RCS = robot.from_WCF_to_RCF(frame_WCS)
    print frame_RCS

    
    robot_frame = robot.RCF
    
    if robot.attached_tool:
        tool0_RCS = robot.from_tcf_to_t0cf([frame_RCS])[0]
        
    else:
        tool0_RCS = frame_RCS
    
    plane_tool0_RCS = draw_frame(tool0_RCS)
    plane_RCS = draw_frame(frame_RCS)
    
    # calculate solutions to frame
    ur_params = ur_params["ur10e"] # get the parameters according to the robot model
    print ur_params
    solutions = inverse_kinematics(tool0_RCS, ur_params)
    print solutions
    
    if not len(solutions):
        joint_values = [0, 0, 0, 0, 0, 0]
        configuration = Configuration.from_prismatic_and_revolute_values([0], joint_values)
        #configuration = Configuration.from_revolute_values(joint_values)
    else:
        joint_values = solutions[idx]
#        print idx
        configuration = [Configuration.from_prismatic_and_revolute_values([lift], joint_values)]
        #configuration = Configuration.from_revolute_values(joint_values)
    print 'RCF', robot.RCF
    print configuration
# ---------- end analytic_inverse ----------

# ----
x_axis_4 = Curve(<curve referenced from the Rhino model>)
y_axis_4 = Curve(<curve referenced from the Rhino model>)
plane_3 = PythonScript(plane_axes=[x_axis_4, y_axis_4])  # -> plane; inputs plane_axes: list of Curve; same code as aa_est
list_9 = ValueList({"ur10e", "ur10e_and_liftkit"}, selected="ur10e")
ik = InverseKinematics(robot=robot_2, plane=filter, start_configuration=forward_kinematics, group=list_9)  # -> configuration
#   port plane: The plane or frame to calculate the inverse kinematic for.
#   port start_configuration: If passed, calculates the inverse such that the joint positions differ the least from the start_configuration. Defaults to the zero configuration.
#   port group: The planning group used for calculation. Defaults to the robot's main planning group.
#   port configuration: The planning group's configuration.
# ---------- ik: Python ----------
"""
Calculate the robot's inverse kinematic for a given plane.

COMPAS FAB v0.27.0
"""
from compas_rhino.conversions import RhinoPlane
from ghpythonlib.componentbase import executingcomponent as component


class InverseKinematics(component):
    def RunScript(self, robot, plane, start_configuration, group):
        configuration = None
        if robot and robot.client and robot.client.is_connected and plane:
            frame = RhinoPlane.from_geometry(plane).to_compas_frame()
            
            frame_BCS = frame.transformed(robot.transformation_WCF_BCF())
            configuration = robot.inverse_kinematics(frame_BCS, start_configuration, group, use_attached_tool_frame=True)
            print configuration
        return configuration
# ---------- end ik ----------

# ---- group: inverse kinematics
# pick_configuration
select_configuration_2 = Slider(2, range=0..7)
picking_inverse = PythonScript(robot=robot_2, lift=l, plane_WCS=pln_6, idx=select_configuration_2, bang=attach_remove.bang)  # -> out, configuration; inputs plane_WCS: Plane, idx: Int32, bang: list of Boolean
# ---------- picking_inverse: Python ----------
import Rhino.Geometry as rg
import math
from compas.geometry import Frame, Transformation, Rotation
from compas_fab.robots import Configuration
from ur_fabrication_control.kinematics.ur_kinematics import inverse_kinematics
from ur_fabrication_control.kinematics.ur_params import ur_params
from compas_ghpython import draw_frame

if robot: 
    robot.lift_height = lift
    
    frame_WCS = Frame(plane_WCS.Origin, plane_WCS.XAxis, plane_WCS.YAxis)
    
    # transform frame to robot coordinate system
    frame_RCS = robot.from_WCF_to_RCF(frame_WCS)
    
    robot_frame = robot.RCF
    
    if robot.attached_tool:
        tool0_RCS = robot.from_tcf_to_t0cf([frame_RCS])[0]
    else:
        tool0_RCS = frame_RCS
    
    plane_tool0_RCS = draw_frame(tool0_RCS)
    plane_RCS = draw_frame(frame_RCS)
    
    # calculate solutions to frame
    ur_params = ur_params["ur10e"] # get the parameters according to the robot model
    print ur_params
    solutions = inverse_kinematics(tool0_RCS, ur_params)
    print solutions
    
    if not len(solutions):
        joint_values = [0, 0, 0, 0, 0, 0]
        configuration = Configuration.from_prismatic_and_revolute_values([0], joint_values)
        #configuration = Configuration.from_revolute_values(joint_values)
    else:
        joint_values = solutions[idx]
        configuration = [Configuration.from_prismatic_and_revolute_values([lift], joint_values)]
        #configuration = Configuration.from_revolute_values(joint_values)
    
#    print configuration
# ---------- end picking_inverse ----------

# pick_configuration_safe
select_configuration_3 = Slider(2, range=0..7)
picking_safe_inverse = PythonScript(robot=robot_2, lift=l, plane_WCS=pln_8, idx=select_configuration_3, bang=attach_remove.bang)  # -> out, configuration; inputs plane_WCS: Plane, idx: Int32, bang: list of Boolean; same code as picking_inverse

# ----
# Plan 'free' motion
list_10 = ValueList({"ur10e", "ur10e_and_liftkit"}, selected="ur10e")
constraints_from_target_configuration = ConstraintsFromTargetConfiguration(robot=robot_2, target_configuration=analytic_inverse.configuration, group=list_10)  # -> constraints
#   port target_configuration: The target configuration.
#   port tolerance_above: The tolerances above the targeted joint value of each configurable joint, defining the upper bound in radians/meters to be achieved.
#   port tolerance_below: The tolerances below the targeted joint value of each configurable joint, defining the lower bound in radians/meters to be achieved.
#   port group: The planning group for which we specify the constraint. Defaults to the robot's main planning group.
#   port constraints: A list joint constraints in radians/meters.
# ---------- constraints_from_target_configuration: Python ----------
"""
Create joint constraints for each of the robot's configurable joints based on a given target configuration.

COMPAS FAB v0.27.0
"""
import math

from ghpythonlib.componentbase import executingcomponent as component
from compas_fab.robots import Configuration


class ConstraintsFromTargetConfiguration(component):
    
    DEFAULT_TOLERANCE_METERS = .001
    DEFAULT_TOLERANCE_RADIANS = math.radians(1)

    def RunScript(self, robot, target_configuration, tolerance_above, tolerance_below, group):
        if robot and target_configuration:
            target_configuration = Configuration.from_revolute_values(target_configuration.revolute_values)
            tolerance_above = tolerance_above or self._generate_default_tolerances(robot.get_configurable_joints(group))
            tolerance_below = tolerance_below or self._generate_default_tolerances(robot.get_configurable_joints(group))

            
            constraints = robot.constraints_from_configuration(
                configuration=target_configuration,
                tolerances_above=tolerance_above,
                tolerances_below=tolerance_below,
                group=group
            )

            return constraints

    def _generate_default_tolerances(self, joints):
        return [
            self.DEFAULT_TOLERANCE_METERS if j.is_scalable()
            else self.DEFAULT_TOLERANCE_RADIANS
            for j in joints
        ]
# ---------- end constraints_from_target_configuration ----------

bang = GhPythonScript(x=[set_base_frame.bang, acm.bang])  # -> out, flatten(x); inputs x: list
# ---------- bang: Python ----------
print x
# ---------- end bang ----------
plan_motion = PlanMotion(
    robot=robot_2,
    goal_constraints=constraints_from_target_configuration,
    start_configuration=picking_safe_inverse.configuration,
    group=list_10,
    compute=button)  # -> trajectory; inputs goal_constraints: list, attached_collision_meshes: list, path_constraints: list, compute: Boolean
#   port goal_constraints: The goal to be achieved, defined in a set of constraints. Constraints can be very specific, for example defining value domains for each joint, such that the goal configuration is included, or defining a volume in space, to which a specific robot link (e.g. the end-effector) is required to move to.
#   port start_configuration: The robot's full configuration, i.e. values for all configurable joints of the entire robot, at the starting position. Defaults to the all-zero configuration.
#   port group: The planning group used for calculation. Defaults to the robot's main planning group.
#   port attached_collision_meshes: A list of attached collision meshes to be included for planning.
#   port path_constraints: Optional constraints that can be imposed along the solution path. Note that path calculation won't work if the start_configuration violates these constraints. Defaults to None.
#   port planner_id: The name of the algorithm used for path planning. Defaults to 'RRTConnect'
#   port compute: If True, calculates a trajectory.
#   port trajectory: The calculated trajectory.
# ---------- plan_motion: Python ----------
"""
Calculate a motion path.

COMPAS FAB v0.27.0
"""
from ghpythonlib.componentbase import executingcomponent as component
from scriptcontext import sticky as st
from compas_fab.robots import JointConstraint
from compas_fab.ghpython.components import create_id


class PlanMotion(component):
    def RunScript(self, robot, goal_constraints, start_configuration, group, attached_collision_meshes, path_constraints, planner_id, compute):

        key = create_id(self, 'trajectory')
        
        path_constraints = list(path_constraints) if path_constraints else None
        
        attached_collision_meshes = list(attached_collision_meshes) if attached_collision_meshes else None
        planner_id = str(planner_id) if planner_id else 'RRTConnect'
        
        if robot and robot.client and robot.client.is_connected and start_configuration and goal_constraints and compute:
            st[key] = robot.plan_motion(goal_constraints,
                                        start_configuration=start_configuration,
                                        group=group,
                                        options=dict(
                                            attached_collision_meshes=attached_collision_meshes,
                                            path_constraints=path_constraints,
                                            planner_id=planner_id,
                                        ))

        trajectory = st.get(key, None)
        return trajectory
# ---------- end plan_motion ----------
trajectory_visualize = TrajectoryVisualize(robot=robot_2, group=list_10, trajectory=plan_motion)  # -> start_configuration, configurations, fraction, time, planes, P, V, A
#   port group: The planning group for which this trajectory was planned.
#   port trajectory: The calculated trajectory.
#   port start_configuration: The start configuration of the trajectory.
#   port configurations: The full configurations along the trajectory.
#   port fraction: Indicates the fraction of requested trajectory that was calculated, e.g. 1 means the full trajectory was found.
#   port time: The time which is needed to execute that trajectory at full speed.
#   port planes: The planes of the robot's end-effector.
#   port P: The positions along the trajectory
#   port V: The velocities along the trajectory
#   port A: The accelerations along the trajectory
# ---------- trajectory_visualize: Python ----------
"""
Visualizes a trajectory.

COMPAS FAB v0.27.0
"""
from compas_ghpython import draw_frame
from compas_ghpython import list_to_ghtree
from compas_fab.robots import Configuration
from ghpythonlib.componentbase import executingcomponent as component
from compas.geometry import Translation

class TrajectoryVisualize(component):
    def RunScript(self, robot, group, trajectory):
        start_configuration = None
        configurations = []
        fraction = 0.
        time = 0.

        planes = []
        positions = []
        velocities = []
        accelerations = []

        if robot and trajectory:
            group = group or robot.main_group_name

            for c in trajectory.points:
                config = robot.merge_group_with_full_configuration(c, trajectory.start_configuration, group)
                joint_names_ordered = ['robot_ewellix_lift_top_joint', 'robot_arm_shoulder_pan_joint', 'robot_arm_shoulder_lift_joint', 'robot_arm_elbow_joint', 'robot_arm_wrist_1_joint', 'robot_arm_wrist_2_joint', 'robot_arm_wrist_3_joint']
                joint_values_ordered = [config.joint_values[config.joint_names.index(joint_name)] for joint_name in joint_names_ordered]
                joint_types_ordered = [config.joint_types[config.joint_names.index(joint_name)] for joint_name in joint_names_ordered]
                mobile_robot_config = Configuration(joint_values_ordered, joint_types_ordered, joint_names_ordered)
                configurations.append(mobile_robot_config)
                frame = robot.forward_kinematics(c, group, options=dict(solver='model'))
                # transform the planes to mobile robot base
                planes.append(draw_frame(frame.transformed(robot.transformation_BCF_WCF())))
                positions.append(c.positions)
                velocities.append(c.velocities)
                accelerations.append(c.accelerations)

            start_configuration = trajectory.start_configuration
            fraction = trajectory.fraction
            time = trajectory.time_from_start

        P = list_to_ghtree(list(zip(*positions)))
        V = list_to_ghtree(list(zip(*velocities)))
        A = list_to_ghtree(list(zip(*accelerations)))

        # return outputs if you have them; here I try it for you:
        #print configurations
        return (start_configuration, configurations, fraction, time, planes, P, V, A)
# ---------- end trajectory_visualize ----------
planes = Plane(trajectory_visualize.planes)
python_10 = GhPythonScript(configurations=trajectory_visualize.configurations, planes=trajectory_visualize.planes)  # -> first_configuration, last_configuration, reversed_free_motion_configurations, last_plane; inputs configurations: list, planes: list of Plane
# ---------- python_10: Python ----------
import rhinoscriptsyntax as rs

if configurations:
    first_configuration = configurations[0]
    last_configuration = configurations[-1]
    reversed_free_motion_configurations = configurations[::-1]

if planes:
    last_plane = planes[-1]
# ---------- end python_10 ----------

# ----
# Pick 'Cartesian' motion
step_3 = Slider(0.1, range=0..0.1)
merge = Merge(Data1=pln_6)  # -> flatten(Result)
plan_cartesian_motion = PlanCartesianMotion(
    robot=robot_2,
    planes_WCF=merge,
    start_configuration=picking_safe_inverse.configuration,
    group=list_10,
    max_step=step_3,
    compute=button)  # -> trajectory; inputs planes_WCF: list, attached_collision_meshes: list, path_constraints: list, compute: Boolean
#   port planes_WCF: The planes or frames through which the path is defined.
#   port start_configuration: The robot's full configuration, i.e. values for all configurable joints of the entire robot, at the starting position. Defaults to the all-zero configuration.
#   port group: The planning group used for calculation. Defaults to the robot's main planning group.
#   port attached_collision_meshes: A list of attached collision meshes to be included for planning.
#   port path_constraints: Optional constraints that can be imposed along the solution path. Note that path calculation won't work if the start_configuration violates these constraints. Defaults to None.
#   port max_step: The approximate distance between the calculated points. (Defined in the robot's units.) Defaults to 0.01.
#   port compute: If True, calculates a trajectory.
#   port trajectory: The calculated trajectory.
# ---------- plan_cartesian_motion: Python ----------
"""
Calculate a cartesian motion path (linear in tool space).

COMPAS FAB v0.28.0
"""
from compas_rhino.conversions import RhinoPlane
from ghpythonlib.componentbase import executingcomponent as component
from scriptcontext import sticky as st

from compas_fab.ghpython.components import create_id


class PlanCartesianMotion(component):
    def RunScript(self, robot, planes_WCF, start_configuration, group, attached_collision_meshes, path_constraints, max_step, compute):

        key = create_id(self, 'trajectory')

        max_step = float(max_step) if max_step else 0.01
        path_constraints = list(path_constraints) if path_constraints else None
        attached_collision_meshes = list(attached_collision_meshes) if attached_collision_meshes else None

        if robot and robot.client and robot.client.is_connected and start_configuration and planes_WCF and compute:
            frames = []
            for plane_WCF in planes_WCF:
                frame_WCF = RhinoPlane.from_geometry(plane_WCF).to_compas_frame()
                frame_BCF = robot.from_WCF_to_BCF(frame_WCF)
                
                frames.append(frame_BCF)
                
            st[key] = robot.plan_cartesian_motion(frames,
                                                  start_configuration=start_configuration,
                                                  group=group,
                                                  options=dict(
                                                      max_step=max_step,
                                                      path_constraints=path_constraints,
                                                      attached_collision_meshes=attached_collision_meshes
                                                  ))

        trajectory = st.get(key, None)
        return trajectory
# ---------- end plan_cartesian_motion ----------
trajectory_visualize_2 = TrajectoryVisualize(robot=robot_2, group=list_10, trajectory=plan_cartesian_motion)  # -> start_configuration, configurations, fraction, time, planes, P, V, A
#   port group: The planning group for which this trajectory was planned.
#   port trajectory: The calculated trajectory.
#   port start_configuration: The start configuration of the trajectory.
#   port configurations: The full configurations along the trajectory.
#   port fraction: Indicates the fraction of requested trajectory that was calculated, e.g. 1 means the full trajectory was found.
#   port time: The time which is needed to execute that trajectory at full speed.
#   port planes: The planes of the robot's end-effector.
#   port P: The positions along the trajectory
#   port V: The velocities along the trajectory
#   port A: The accelerations along the trajectory
# ---------- trajectory_visualize_2: Python ----------
"""
Visualizes a trajectory.

COMPAS FAB v0.27.0
"""
from compas_ghpython import draw_frame
from compas_ghpython import list_to_ghtree
from compas_fab.robots import Configuration
from ghpythonlib.componentbase import executingcomponent as component
from compas.geometry import Translation

class TrajectoryVisualize(component):
    def RunScript(self, robot, group, trajectory):
        start_configuration = None
        configurations = []
        fraction = 0.
        time = 0.

        planes = []
        positions = []
        velocities = []
        accelerations = []

        if robot and trajectory:
            group = group or robot.main_group_name
            print len(trajectory.points)

            for c in trajectory.points:
                print len(c)
                config = robot.merge_group_with_full_configuration(c, trajectory.start_configuration, group)
                joint_names_ordered = ['robot_ewellix_lift_top_joint', 'robot_arm_shoulder_pan_joint', 'robot_arm_shoulder_lift_joint', 'robot_arm_elbow_joint', 'robot_arm_wrist_1_joint', 'robot_arm_wrist_2_joint', 'robot_arm_wrist_3_joint']
                joint_values_ordered = [config.joint_values[config.joint_names.index(joint_name)] for joint_name in joint_names_ordered]
                joint_types_ordered = [config.joint_types[config.joint_names.index(joint_name)] for joint_name in joint_names_ordered]
                mobile_robot_config = Configuration(joint_values_ordered, joint_types_ordered, joint_names_ordered)
                configurations.append(mobile_robot_config)
                frame = robot.forward_kinematics(c, group, options=dict(solver='model'))
                # transform the planes to mobile robot base
                planes.append(draw_frame(frame.transformed(robot.transformation_BCF_WCF())))
                positions.append(c.positions)
                velocities.append(c.velocities)
                accelerations.append(c.accelerations)

            start_configuration = trajectory.start_configuration
            fraction = trajectory.fraction
            time = trajectory.time_from_start

        P = list_to_ghtree(list(zip(*positions)))
        V = list_to_ghtree(list(zip(*velocities)))
        A = list_to_ghtree(list(zip(*accelerations)))

        # return outputs if you have them; here I try it for you:
        #print configurations
        return (start_configuration, configurations, fraction, time, planes, P, V, A)
# ---------- end trajectory_visualize_2 ----------
ghpython_script = GhPythonScript(free_motion_configs=trajectory_visualize.configurations, cartesian_motion_configs=trajectory_visualize_2.configurations)  # -> out, combined_motion_configs; inputs free_motion_configs: list, cartesian_motion_configs: list
# ---------- ghpython_script: Python ----------
combined_motion_configs = []

combined_motion_configs.extend(free_motion_configs)
combined_motion_configs.extend(cartesian_motion_configs)
# ---------- end ghpython_script ----------
planes_2 = Plane(trajectory_visualize_2.planes)

# ----
# Pace 'Cartesian' motion
step_4 = Slider(0.1, range=0..0.1)
merge_2 = Merge(Data1=pln_9)  # -> flatten(Result)
list_item = ListItem(List=trajectory_visualize.configurations, Index=0, Wrap=True)  # -> Item1, Item
plan_cartesian_motion_2 = PlanCartesianMotion(robot=robot_2, planes_WCF=merge_2, start_configuration=list_item.Item1, group=list_10, max_step=step_4, compute=button)  # -> trajectory; inputs planes_WCF: list, attached_collision_meshes: list, path_constraints: list, compute: Boolean; same code as plan_cartesian_motion
trajectory_visualize_3 = TrajectoryVisualize(robot=robot_2, group=list_10, trajectory=plan_cartesian_motion_2)  # -> start_configuration, configurations, fraction, time, planes, P, V, A; same code as trajectory_visualize_2
ghpython_script_2 = GhPythonScript(free_motion_configs=trajectory_visualize.configurations, cartesian_motion_configs=trajectory_visualize_3.configurations)  # -> out, combined_motion_configs; inputs free_motion_configs: list, cartesian_motion_configs: list; same code as ghpython_script
planes_3 = Plane(trajectory_visualize_3.planes)

list_11 = ValueList({"0 zero_configuration": 0, "1 forward_kinematics": 1, "2 inverse_kinematics analytical": 2, "3 inverse_kinematics MoveIt": 3, "4 motion_planning": 4, "5 free_motion_planning": 5, "6 'pick_and_place_routine'": 6, "7 from json": 7, "8 picking configuration": 8, "9 pick safe configuration": 9, "10 place cartesian motion": 10}, selected="2 inverse_kinematics analytical")
filter_2 = StreamFilter(
    Gate=list_11,
    Stream0=zero_config,
    Stream1=forward_kinematics,
    Stream2=analytic_inverse.configuration,
    Stream3=ik,
    Stream4=python_10.last_configuration,
    Stream5=trajectory_visualize.configurations,
    Stream8=picking_inverse.configuration,
    Stream9=picking_safe_inverse.configuration,
    Stream10=ghpython_script_2.combined_motion_configs)

# ----
# Visualisation
show_end_effector_frame = BooleanToggle(False)
show_base_frame = BooleanToggle(True)
show_collision = BooleanToggle(False)
show_frames = BooleanToggle(True)
show_visual = BooleanToggle(True)
show_reach = BooleanToggle(False)
show_acm = BooleanToggle(True)
show_cm = BooleanToggle(False)
robot_visualize = RobotVisualize(
    robot=robot_2,
    group=list_9,
    configuration=filter_2,
    show_visual=show_visual,
    show_collision=show_collision,
    show_frames=show_frames,
    show_base_frame=show_base_frame,
    show_robot_frame=show_robot_frame,
    show_end_effector_frame=show_end_effector_frame,
    show_reach=show_reach,
    show_cm=show_cm,
    show_acm=show_acm,
    redraw=bang.x)  # -> visual, collision, collision_meshes, attached_meshes, all_frames, base_frame, robot_frame, ee_frame, reach; inputs show_visual: Boolean, show_collision: Boolean, show_frames: Boolean, show_base_frame: Boolean, show_end_effector_frame: Boolean, show_cm: Boolean, show_acm: Boolean, redraw: list
#   port group: The planning group used for end-effector and base visualization.
#   port configuration: The robot's full configuration.
#   port show_visual: Whether or not to show the robot's visual meshes.
#   port show_collision: Whether or not to show the robot's collision meshes.
#   port show_frames: Whether or not to show the robot's joint frames.
#   port show_base_frame: Whether or not to show the robot's base frame.
#   port show_end_effector_frame: Whether or not to show the robot's end-effector frame.
#   port show_cm: Whether or not to show the collision meshes (if any).
#   port show_acm: Whether or not to show the attached collision meshes (if any).
#   port visual: Rhino meshes of the robot's visual geometry (if any).
#   port collision: Rhino meshes of the robot's collision geometry (if any).
#   port collision_meshes: Rhino meshes of the scene's collision meshes (if any).
#   port attached_meshes: Rhino meshes of the scene's attached collision meshes (if any).
#   port all_frames: The robot's joint frames as Rhino planes (if any).
#   port base_frame: The robot's base frame as a Rhino plane (if any).
#   port ee_frame: The robot's end-effector frame as a Rhino plane (if any).
# ---------- robot_visualize: Python ----------
"""
Visualizes the robot.

COMPAS FAB v0.27.0
"""
import Rhino.Geometry as rg
import ghpythonlib.components as ghcomp
from compas.artists import Artist
from compas.geometry import Frame
from compas.geometry import Transformation
from compas_fab.robots import PlanningScene
from compas_ghpython.utilities import draw_frame
from ghpythonlib.componentbase import executingcomponent as component

class RobotVisualize(component):
    def RunScript(
        self,
        robot,
        group,
        configuration,
        show_visual,
        show_collision,
        show_frames,
        show_base_frame,
        show_robot_frame,
        show_end_effector_frame,
        show_reach,
        show_cm,
        show_acm,
        redraw
    ):

        visual = None
        collision = None
        collision_meshes = None
        attached_meshes = None
        frames = None
        base_frame = None
        robot_frame = None
        ee_frame = None
        all_frames = None
        reach = None

        if robot:
            show_visual = True if show_visual is None else show_visual
            show_cm = True if show_cm is None else show_cm
            show_acm = True if show_acm is None else show_acm
            configuration = configuration or robot.zero_configuration()

            robot.update(configuration, visual=show_visual, collision=show_collision)
            frames = robot.transformed_frames(configuration, group)

            if show_visual:
                visual = robot.artist.draw_visual()
                # orient the robot to its base plane:
                robot_BCF = draw_frame(robot.BCF) 
                init_robot_plane = rg.Plane.WorldXY
                visual = ghcomp.Orient(visual, init_robot_plane, robot_BCF)[0]

            if show_collision:
                collision = robot.artist.draw_collision()

            if show_base_frame:
                base_frame = robot.BCF

            if show_robot_frame:
                robot_frame = robot.RCF
                #robot_frame = robot.to_world_coordinates(robot_frame)
                
            if show_end_effector_frame:
                ee_frame = robot.forward_kinematics(
                    configuration, group, options=dict(solver="model")
                )

            if show_frames:
                all_frames = [robot.from_BCF_to_WCF(frame) for frame in frames]
                
            if show_reach:
                ur_base_plane = draw_frame(robot.RCF)
                reach = rg.Sphere(ur_base_plane, 1.25 + robot.attached_tool.frame.point.z)

            if show_cm or show_acm:
                scene = PlanningScene(robot)
                scene = robot.client.get_planning_scene()

                collision_meshes = []
                attached_meshes = []

                if show_cm:
                    for co in scene.world.collision_objects:
                        header = co.header
                        frame_id = header.frame_id
                        cms = co.to_collision_meshes()

                        for cm in cms:
                            if cm.frame != Frame.worldXY():
                                t = Transformation.from_frame(cm.frame)
                                mesh = cm.mesh.transformed(t)
                            else:
                                mesh = cm.mesh
                            
                            mesh_t = mesh.transformed(robot.transformation_BCF_WCF())
                            collision_meshes.append(Artist(mesh_t).draw())

                if show_acm:
                    for aco in scene.robot_state.attached_collision_objects:
                        for acm in aco.to_attached_collision_meshes():
                            frame_id = aco.object["header"]["frame_id"]
                            frame = robot.forward_kinematics(
                                configuration, options=dict(link=frame_id)
                            )
                            t = Transformation.from_frame(frame)

                            # Local CM frame
                            if (
                                acm.collision_mesh.frame
                                and acm.collision_mesh.frame != Frame.worldXY()
                            ):
                                t = t * Transformation.from_frame(
                                    acm.collision_mesh.frame
                                )

                            mesh = acm.collision_mesh.mesh.transformed(t)
                            # transform to mobile robot base
                            mesh_t = mesh.transformed(robot.transformation_BCF_WCF())

                            attached_meshes.append(Artist(mesh_t).draw())

        return (
            visual,
            collision,
            collision_meshes,
            attached_meshes,
            all_frames,
            base_frame,
            robot_frame,
            ee_frame,
            reach
        )
# ---------- end robot_visualize ----------
geo_2 = Geometry(robot_visualize.reach)
geo_3 = Geometry(robot_visualize.visual)
geo_4 = Geometry(robot_visualize.collision)
geo_5 = Geometry(robot_visualize.collision_meshes)
geo_6 = Geometry(robot_visualize.attached_meshes)
draw_4 = GhPythonScript(
    frames=[robot_visualize.robot_frame, robot_visualize.all_frames, robot_visualize.ee_frame],
    scale=Slider(0.2, range=0..1))  # -> P, V, C, W; inputs frames: list
# ---------- draw_4: Python ----------
from System.Drawing import Color
from compas_ghpython.utilities import draw_frame

red = Color.FromArgb(255, 0, 0)
green = Color.FromArgb(0, 255, 0)
blue = Color.FromArgb(0, 0, 255)

P = []
V = []
C = []

scale = float(scale)

for frame in frames:
    if not frame:
        continue
    plane = draw_frame(frame)
    P += [plane.Origin] * 3
    V.append(plane.XAxis * scale)
    V.append(plane.YAxis * scale)
    V.append(plane.ZAxis * scale)
    C += [red, green, blue]

W = 3
# ---------- end draw_4 ----------
preview_6 = CustomPreview(Geometry=geo_2, Shader=ColourSwatch(SwatchColor=RGB(255, 255, 255)))
preview_7 = CustomPreview(Geometry=geo_3, Shader=ColourSwatch(SwatchColor=RGB(105, 105, 105)))
preview_8 = CustomPreview(Geometry=[geo_5, geo_6, geo_4], Shader=ColourSwatch(SwatchColor=RGB(255, 255, 255)))
vdisex = VectorDisplayEx(Point=draw_4.P, Vector=draw_4.V, Colour=draw_4.C, Width=draw_4.W)

list_item_2 = ListItem(List=filter_2, Index=configuration, Wrap=True)
panel_13 = Panel(filter_2)

# ----
# Select
# Config
configuration_2 = Slider(23, range=0..100)
item = ListItem(List=trajectory_visualize.configurations, Index=configuration_2, Wrap=True)

# ----
# Move Joints
list_12 = ValueList({"send one configuration": 0, "send multiple configuration": 1}, selected="send one configuration")
radius = Slider(0, range=0..0.5)
filter_3 = StreamFilter(Gate=list_12, Stream0=filter_2, Stream1=trajectory_visualize.configurations)
move_joint = PythonScript(configurations=filter_3, velocity=Slider(0.051, range=0..0.5), radius=radius)  # -> urscript, lift, values; inputs configurations: list
# ---------- move_joint: Python ----------
from ur_fabrication_control.direct_control import URScript
from compas_fab.robots import Configuration
import math

urscript = URScript()
urscript.start()
for configuration in configurations:
    joint_configuration = Configuration.from_revolute_values(configuration.revolute_values)
    #lift = configuration
    urscript.move_joint(joint_configuration, velocity, radius)
    #urscript.move_joint(configuration, velocity)
urscript.end()

urscript = urscript.generate()

print(urscript)
# ---------- end move_joint ----------
send_3 = Button()
ur_send = GhPythonScript(urscript=move_joint.urscript, send=send_3)  # -> out; inputs send: Boolean
# ---------- ur_send: Python ----------
from scriptcontext import sticky as st
from ur_fabrication_control.direct_control import send_script

ur_ip = st["ur_ip"]
ur_port = st["ur_port"]

print urscript

if send:
    send_script(urscript, ur_ip, ur_port)
# ---------- end ur_send ----------

# ----
# Move Cartesian
list_13 = ValueList({"send one cartesian position": 0, "send all cartesian positions": 1}, selected="send all cartesian positions")
radius_2 = Slider(0, range=0..0.5)
filter_4 = StreamFilter(Gate=list_13, Stream1=python_9.picking_frame_RCF)
movel_linear = PythonScript(robot=robot_2, frames_RCS=filter_4, velocity=Slider(0.044, range=0..0.5), radius=radius_2)  # -> urscript; inputs frames_RCS: list
# ---------- movel_linear: Python ----------
import Rhino.Geometry as rg
from compas.geometry import Frame
from compas.geometry import Transformation, Rotation
from compas_ghpython import draw_frame
from ur_fabrication_control import direct_control 
import math

from scriptcontext import sticky as st
from ur_fabrication_control.direct_control import URScript

# retrieve the current tool frame in axis angle format
if robot.attached_tool:
    tool_angle_axis = list(robot.attached_tool.frame.point) + list(robot.attached_tool.frame.axis_angle_vector)
else:
    tool0_frame = Frame([0, 0, 0], [1, 0, 0], [0, 1, 0])
    tool_angle_axis = list(tool0_frame.point) + list(tool0_frame.axis_angle_vector)


urscript = URScript()
urscript.start()
urscript.set_tcp(tool_angle_axis)
for frame_RCS in frames_RCS:
    urscript.move_linear(frame_RCS, velocity, radius)
urscript.end()

urscript = urscript.generate()

print(urscript)
# ---------- end movel_linear ----------
send_4 = Button()
ur_send_2 = GhPythonScript(urscript=movel_linear, send=send_4)  # -> out; inputs send: Boolean; same code as send_2

# ----
# Generate 'pick and place' commands
number_slider_3 = Slider(0.045, range=0..0.35)
send_5 = Button()
radius_3 = Slider(0.01, range=0..0.1)
generate_ur_script = PythonScript(
    robot=robot_2,
    picking_configuration_safe=picking_safe_inverse.configuration,
    picking_configuration=picking_inverse.configuration,
    placing_configurations_freemotion=trajectory_visualize.configurations,
    placing_configurations_cartesian=trajectory_visualize_3.configurations,
    picking_frame_RCF=python_9.picking_frame_RCF,
    picking_frame_safe_RCF=python_9.picking_frame_safe_RCF,
    placing_plane_safe=pln_7,
    placing_plane=pln_9,
    routine=list_4,
    velocity=number_slider_3,
    radius=radius_3)  # -> out, placing_frame_safe_RCF, urscript; inputs placing_configurations_freemotion: list, placing_configurations_cartesian: list, routine: Int32
# ---------- generate_ur_script: Python ----------
from ur_fabrication_control.direct_control import URScript
from ur_fabrication_control.direct_control.mixins import AreaGripMixins
from compas_fab.robots import Configuration

import math
from scriptcontext import sticky as st
import Rhino.Geometry as rg

from compas.geometry import Frame, Transformation


class URScript_RSRD(URScript, AreaGripMixins):
    pass

tool_angle_axis = list(robot.attached_tool.frame.point) + list(robot.attached_tool.frame.axis_angle_vector)
sleep = 3.0


def plane_to_frame_RCF(plane_WCS):
    frame_WCS = Frame(plane_WCS.Origin, plane_WCS.XAxis, plane_WCS.YAxis)
    frame_BCS = frame_WCS.transformed(robot.transformation_WCF_BCF())
    frame_RCS = frame_BCS.transformed(robot.transformation_BCF_RCF())
    return frame_RCS

placing_frame_RCF = plane_to_frame_RCF(placing_plane) 
placing_frame_safe_RCF = plane_to_frame_RCF(placing_plane_safe)
    
#traj_frames = []
#for plane in traj_planes_WCF:
#    traj_frames.append(plane_to_frame(plane))


placing_configurations_freemotion_reversed = placing_configurations_freemotion[::-1]
placing_configurations_cartesian_reversed = placing_configurations_cartesian[::-1]
#print reversed_joints

# placing
if routine == 0:
    commands = URScript_RSRD()
    commands.start()
    commands.set_payload(1.140)
    commands.set_tcp(tool_angle_axis)
    #commands.move_joint(picking_configuration, velocity) 
   # commands.move_linear(picking_frame_RCF, 0.1, radius=0.0)
    #commands.areagrip_on()
    #commands.add_line("\tsleep({})".format(1.0))
    #commands.set_payload(4.340)
    #commands.move_linear(picking_frame_safe_RCF, 0.1, radius)
    #commands.move_joint(freemotion_start_config, velocity) ### check approach_from!!!
    
    for configuration in placing_configurations_freemotion:
        joint_configuration = Configuration.from_revolute_values(configuration.revolute_values)
        commands.move_joint(joint_configuration, velocity, radius)
        
    for configuration in placing_configurations_cartesian:
        joint_configuration = Configuration.from_revolute_values(configuration.revolute_values)
        commands.move_joint(joint_configuration, velocity, radius=0.0)
        
#    commands.move_linear(placing_frame_safe_RCF, 0.1, radius=0.0)  
#    commands.move_linear(placing_frame_RCF, 0.1, radius=0.0)  
    commands.end()  

## releasing
if routine == 1:
    commands = URScript_RSRD()
    commands.start()
    commands.set_payload(4.340)
    commands.set_tcp(tool_angle_axis)
    commands.areagrip_off()
    #commands.set_payload(1.140)
    #commands.move_linear(placing_frame_safe_RCF, 0.1, radius)
    
    for configuration in placing_configurations_cartesian_reversed:
        joint_configuration = Configuration.from_revolute_values(configuration.revolute_values)
        commands.move_joint(joint_configuration, velocity, radius)
    
    for configuration in placing_configurations_freemotion_reversed:
        joint_configuration = Configuration.from_revolute_values(configuration.revolute_values)
        commands.move_joint(joint_configuration, velocity, radius)
        
    #commands.move_joint(picking_configuration, velocity)
    commands.end() 


if routine == 2:
    commands = URScript_RSRD()
    commands.start()
    commands.set_tcp(tool_angle_axis)
    commands.move_linear(placing_frame_RCF, velocity, radius)
    commands.end()  
    
if routine == 3:
    commands = URScript_RSRD()
    commands.start()
    commands.set_tcp(tool_angle_axis)
    commands.move_linear(placing_frame_safe_RCF, velocity, radius)
    commands.end() 

urscript = commands.generate()

print(urscript)
# ---------- end generate_ur_script ----------
send_6 = GhPythonScript(urscript=generate_ur_script.urscript, send=send_5)  # -> out; inputs send: Boolean
# ---------- send_6: Python ----------
from scriptcontext import sticky as st
from ur_fabrication_control.direct_control import send_script

ur_ip = st["ur_ip"]
ur_port = st["ur_port"]

print urscript
if send:
    send_script(urscript, ur_ip, ur_port)
# ---------- end send_6 ----------

# ----
# Get Pose Joint
get = Button()
pose = PythonScript(robot=robot_2, get=get)  # -> out, configuration, pose_joints
# ---------- pose: Python ----------
from scriptcontext import sticky as st
from ur_fabrication_control.direct_control.common import get_current_pose_joints
from compas_fab.robots import Configuration



server_ip= st["server_ip"]
server_port = st["server_port"]
ur_port = st["ur_port"]
ur_ip = st["ur_ip"]
print ur_ip

guid = str(ghenv.Component.InstanceGuid)
pose_joints_key = "pose_joints" + guid

# retrieve the current tool frame in axis angle format
if robot.attached_tool:
    tool_angle_axis = list(robot.attached_tool.frame.point) + list(robot.attached_tool.frame.axis_angle_vector)
else:
    tool0_frame = Frame([0, 0, 0], [1, 0, 0], [0, 1, 0])
    tool_angle_axis = list(tool0_frame.point) + list(tool0_frame.axis_angle_vector)

print(tool_angle_axis)

# send script to the robot to receive the current joint configuration
if get:
    st[pose_joints_key] = get_current_pose_joints(server_ip, server_port, ur_ip, ur_port, tool_angle_axis)

print(st[pose_joints_key])

configuration = Configuration.from_revolute_values(st[pose_joints_key])
pose_joints = configuration.joint_values

"""
if pose_joints_key not in st:
    configuration = Configuration.from_revolute_values([0,0,0,0,0,0])
else:
    configuration = Configuration.from_revolute_values(st[pose_joints_key])

pose_joints = configuration.values
"""
# ---------- end pose ----------
panel_14 = Panel(pose.pose_joints)

# ----
# Lift controller
send_7 = Button()
lift_send = GhPythonScript(robot=robot_2, lift=l, send=send_7)  # -> out
# ---------- lift_send: Python ----------
if send:
    robot.mobile_client.set_lift_height(lift)
# ---------- end lift_send ----------

rcf_wcs_aa_0 = Plane(Plane(origin=(-0.651762, 1.000848, 0.359071), x=(-0.1925049999, 0.9812949996, 0.001395999999), y=(-0.9812656017, -0.1924876471, -0.008143995887)))
calc_bcf_wcs_2 = GhPythonScript(robot=robot_2, RCF_WCS_plane=rcf_wcs_aa_0)  # -> out, RCF_OCS_plane, BCF_WCS_plane
# ---------- calc_bcf_wcs_2: Python ----------
import rhinoscriptsyntax as rs
from compas_rhino.conversions import frame_to_rhino_plane, plane_to_compas_frame
from compas.geometry import Frame, Transformation, Translation

if robot:
    #RCF_OCS_plane = frame_to_rhino_plane(robot.RCF) # TODO: RCF should move with BCF !!!! NEEDS TO BE CHECKED !!!!
    
    RCF_WCS = plane_to_compas_frame(RCF_WCS_plane)
    
    
    #print robot.RCF
    #print robot.BCF
    
    #Version A
    
    #RCF_RCS = RCF_WCS.transformed(robot.transformation_WCF_RCF())
    #BCF_WCS_A = RCF_RCS.transformed(robot.transformation_BCF_WCF())
    #
    #BCF_WCS_A_plane = frame_to_rhino_plane(BCF_WCS_A)
    #BCF_WCS_plane = BCF_WCS_A_plane
    
    #Version B
    #
    T2 = Transformation.from_frame_to_frame(robot.RCF, RCF_WCS)
    print robot.RCF
    BCF_WCS_B = Frame.worldXY().transformed(T2)
    BCF_WCS_B_plane = frame_to_rhino_plane(BCF_WCS_B)
    
    BCF_WCS_plane = BCF_WCS_B_plane
# ---------- end calc_bcf_wcs_2 ----------
pln_13 = Plane(calc_bcf_wcs_2.RCF_OCS_plane)

pln_14 = Plane(calc_bcf_wcs_2.BCF_WCS_plane)

# ----
# Planning settings
tolerance_vector = Vector(Vector(0, 0, 0.001))
python_11 = PythonScript(
    robot=robot_2,
    element0=elem_def.elem_full,
    data_path=py_2.DATA,
    tolerance_vector=tolerance_vector,
    picking_configuration=picking_safe_inverse.configuration,
    freemotion_start_config=picking_safe_inverse.configuration,
    picking_frame=python_9.picking_frame_RCF,
    picking_frame_safe=python_9.picking_frame_safe_RCF,
    current_element=element)  # -> element_acm, picking_frame, picking_plane, safelevel_picking_frame, safelevel_target_frame, target_frame, picking_element_mesh; inputs collision_meshes: list of Mesh, collision_names: list
# ---------- python_11: Python ----------
import os
import json

from compas.geometry import Frame, Vector, Point
from compas_fab.robots import Configuration
from compas.geometry import Transformation, Translation
from compas.artists import Artist
from compas_fab.robots import CollisionMesh, AttachedCollisionMesh

if robot:

    settings_file = os.path.join(data_path, "settings.json")
    
    # convert
    tolerance_vector = Vector(*list(tolerance_vector))
    #safelevel_vector = Vector(*list(safelevel_vector))
    
    # create attached collision object
    element0_tool0 = element0.copy()
    T = Transformation.from_frame_to_frame(element0_tool0._tool_frame, robot.attached_tool.frame)
    element0_tool0.transform(T)
    ee_link_name = robot.get_end_effector_link_name()
    element_acm = AttachedCollisionMesh(CollisionMesh(element0_tool0.mesh, 'brick'), ee_link_name)
    
    #picking_frame = robot.get_picking_frame()
    #T1 = Translation.from_vector(picking_frame.zaxis*0.01)
    #picking_frame.transform(T1)
    
    #mesh_WCS = RhinoMesh.from_geometry(collision_meshes).to_compas()
    
#    picking_frame = Frame(picking_plane.Origin, picking_plane.XAxis, picking_plane.YAxis)
#    picking_frame_safe = Frame(picking_plane_safe.Origin, picking_plane_safe.XAxis, picking_plane_safe.YAxis)
#    placing_frame_safe = Frame(placing_plane_safe.Origin, placing_plane_safe.XAxis, placing_plane_safe.YAxis)
    
    picking_configuration = Configuration((0.0, -2.823, -1.822, 2.273, -2.022, -1.571, -0.466), (2, 0, 0, 0, 0, 0, 0))
    data = {}
    data['picking_configuration'] = picking_configuration.data
    data['start_configuration'] = freemotion_start_config.data
    data['picking_frame'] = picking_frame.data
    data['picking_frame_safe'] = picking_frame_safe.data
    data['placing_frame_safe'] = placing_frame_safe.data
    data['placing_frame'] = placing_frame.data
    data['tolerance_vector'] = tolerance_vector.data
    data['element0'] = element0.data
    data['collision_meshes'] = [mesh.data for mesh in collision_meshes]
    data['collision_names'] = list(collision_names)
    
    with open(settings_file, 'w') as f:
        json.dump(data, f)
    
    #safelevel_picking_frame = picking_frame.copy()
    #brick_at_picking_frame = element0.transformed(Transformation.from_frame_to_frame(element0._tool_frame, picking_frame))
    #picking_element_mesh = Artist(brick_at_picking_frame.mesh).draw()
    
    #picking_frame.point += tolerance_vector
    #safelevel_picking_frame.point += safelevel_vector
    
    #target_frame = current_element._tool_frame.copy()
    #target_frame.point += tolerance_vector
    #safelevel_target_frame = target_frame.copy()
    #safelevel_target_frame.point += safelevel_vector
    
    #picking_plane = Artist(picking_frame).draw()
# ---------- end python_11 ----------
preview_9 = CustomPreview(Geometry=python_11.picking_element_mesh, Shader=ColourSwatch(SwatchColor=RGBA(201, 145, 71, 218)))
number_slider_4 = Slider(0.05, range=0..1)
draw_5 = GhPythonScript(frames=[python_11.picking_frame, python_11.safelevel_picking_frame], scale=number_slider_4)  # -> P, V, C, W; inputs frames: list; same code as draw_4
draw_6 = GhPythonScript(frames=[python_11.safelevel_target_frame, python_11.target_frame], scale=number_slider_4)  # -> P, V, C, W; inputs frames: list; same code as draw_4
vdisex_2 = VectorDisplayEx(Point=draw_5.P, Vector=draw_5.V, Colour=draw_5.C, Width=draw_5.W)
vdisex_3 = VectorDisplayEx(Point=draw_6.P, Vector=draw_6.V, Colour=draw_6.C, Width=draw_6.W)

# ----
# Get Pose Cartesian
get_2 = Button()
pose_2 = PythonScript(robot=robot_2, get=get_2)  # -> out, pose_cartesian
# ---------- pose_2: Python ----------
from scriptcontext import sticky as st
#from ur_fabrication_control.online_control.ur_direct import get_current_pose_cartesian

from ur_fabrication_control.direct_control.common import get_current_pose_cartesian
from compas.geometry import Frame
from compas_ghpython import draw_frame


server_ip = st["server_ip"]
server_port = st["server_port"]
ur_port = st["ur_port"]
ur_ip = st["ur_ip"]
pose_cartesian_meter = []
print ur_ip

# retrieve the current tool frame in axis angle format
if robot.attached_tool:
    print ("attached")
    tool_angle_axis = list(robot.attached_tool.frame.point) + list(robot.attached_tool.frame.axis_angle_vector)
    
else:
    tool0_frame = Frame([0, 0, 0], [1, 0, 0], [0, 1, 0])
    tool_angle_axis = list(tool0_frame.point) + list(tool0_frame.axis_angle_vector)

print(tool_angle_axis)

guid = str(ghenv.Component.InstanceGuid)
pose_cartesian_key = "pose_cartesian" + guid


if get:
    print ("getting pose")
    st[pose_cartesian_key] = get_current_pose_cartesian(tool_angle_axis, server_ip, server_port, ur_ip, ur_port, send=True)
#    st[pose_cartesian_key] = get_current_pose_cartesian(server_ip, server_port, ur_ip, tool_angle_axis)
    

if pose_cartesian_key not in st:
    pose_cartesian_mm = []
    pose_cartesian_meter = []
else:
    pose_cartesian = st[pose_cartesian_key]
# ---------- end pose_2 ----------

# ----
# Calculate Basis - 3-Point Method
# Measure basis:
# 1. Clear the recorded poses
# 2. Move robot to origin and press "get pose"
# 3. Move robot to point in positive x-axis and press "get pose"
# 4. Move robot to an other point in your basis and press "get pose"
# (The further away these positions are, the better)
# 
# 5. Alternatively change the order in the component calc base
# 6. Copy output into base component (TODO: check if it has to be inverted)
list_14 = ValueList({"o, pos.x-axis, xy pl": 0, "o, pos.y-axis, xy pl": 1}, selected="o, pos.x-axis, xy pl")
clear = Button()
rec = PythonScript(msg=pose_2.pose_cartesian, rec=get_2, clear=clear)  # -> rec; inputs msg: list
# ---------- rec: Python ----------
from scriptcontext import sticky as st

guid = str(ghenv.Component.InstanceGuid)
recorded_key =  "recorded_" + guid
just_cleared_key = "just_cleared_" + guid


if recorded_key not in st:
    st[recorded_key] = []

if just_cleared_key not in st:
    st[just_cleared_key] = False

if clear:
    st[recorded_key] = []
    st[just_cleared_key] = True
else:
    if len(msg):
        if msg != [None] and not st[just_cleared_key] and rec:
            st[recorded_key].append(msg)
    st[just_cleared_key] = False
        


rec = st[recorded_key]

print rec
# ---------- end rec ----------
calc_robot_plane = PythonScript(poses=rec, input_type=list_14)  # -> out, robot_plane, base_plane; inputs poses: list
# ---------- calc_robot_plane: Python ----------
import Rhino.Geometry as rg
import math


if len(poses) > 2:
    
    O = poses[0]
    P1 = poses[1]
    P2 = poses[2]
    
    if input_type == 0:
        # origin, pt on positive x-axis, pt in xy plane
        origin = rg.Point3d(O[0], O[1], O[2])
        pt_on_xaxis = rg.Point3d(P1[0], P1[1], P1[2])
        pt_in_xyplane = rg.Point3d(P2[0], P2[1], P2[2])
        
        xaxis = pt_on_xaxis - origin
        xaxis.Unitize()
        
        v = pt_in_xyplane - origin
        zaxis = rg.Vector3d.CrossProduct(v, xaxis)
        zaxis.Unitize()
        
        # zaxis must look up!
        if math.acos(rg.Vector3d.ZAxis * zaxis) > math.acos(rg.Vector3d.ZAxis * -zaxis):
            zaxis = -zaxis
        
        yaxis = rg.Vector3d.CrossProduct(zaxis, xaxis)
    
    elif input_type == 1:
        # origin, pt on positive y-axis, pt in xy plane
        origin = rg.Point3d(O[0], O[1], O[2])
        pt_on_yaxis = rg.Point3d(P1[0], P1[1], P1[2])
        pt_in_xyplane = rg.Point3d(P2[0], P2[1], P2[2])
        
        yaxis = pt_on_yaxis - origin
        yaxis.Unitize()
        
        v = pt_in_xyplane - origin
        zaxis = rg.Vector3d.CrossProduct(v, yaxis)
        zaxis.Unitize()
        
        # zaxis must look up!
        if math.acos(rg.Vector3d.ZAxis * zaxis) > math.acos(rg.Vector3d.ZAxis * -zaxis):
            zaxis = -zaxis
        
        xaxis = rg.Vector3d.CrossProduct(yaxis, zaxis)
        
        
    print "Copy the following into base component:"
    print " "
    print "origin = [%.2f, %.2f, %.2f]" % tuple(list(origin))
    print "xaxis = [%.5f, %.5f, %.5f]" % tuple(list(xaxis))
    print "yaxis = [%.5f, %.5f, %.5f]" % tuple(list(yaxis))
    

#print rg.Vector3d.CrossProduct(rg.Vector3d.YAxis, rg.Vector3d.ZAxis)
#print rg.Vector3d.CrossProduct(rg.Vector3d.ZAxis, rg.Vector3d.XAxis)

    robot_plane = rg.Plane(origin, xaxis, xaxis)
# ---------- end calc_robot_plane ----------
panel_15 = Panel(rec)
panel_16 = Panel(calc_robot_plane.out)

# ----
# Direct UR control + Lift control
rec_2 = DataRecorder(pose_2.out, DataLimit=-10, RecordData=True)
pln_15 = Plane(calc_robot_plane.robot_plane)

panel_17 = Panel(rec_2)

# ----
# Calculate Basis - Point fitting method via RPC
toggle = BooleanToggle(False)
pt_2 = Point([<point referenced from the Rhino model> x3])
calc_rcf = PythonScript(poses=rec, pts_cad=pt_2, RCF_plane_init_guess=pln_3, calc=toggle)  # -> out, pts_mtip_init_guess, pts_mtip_fit, RCF_plane_fit, RCF_frame_fit; inputs poses: list, pts_cad: list of Point3d, RCF_plane_init_guess: Plane
# ---------- calc_rcf: Python ----------
import ghpythonlib.components as ghcomp
import Rhino.Geometry as rg
from scriptcontext import sticky as st
from compas.geometry import Frame
from compas.artists import Artist
import math as m
import sys
from compas.rpc import Proxy # for calling the numpy function in CPython

#icp_func = Proxy('ur_fabrication_control.optimisation.icp', python = 'C://Users//doerf//.conda//envs//rsrd_22//python.exe') #C:\Users\doerf\.conda\envs\rsrd_22
#print icp_func._python
#print poses

#RCF_plane_init_guess = Artist(RCF_frame_init_guess).draw()

#poses = [[-0.58718800000000004, -0.18371299999999999, -1.0307900000000001, -2.7211500000000002, -0.58718700000000001, 0.359176], [-0.57886499999999996, -0.51754, -1.0328200000000001, -2.5670999999999999, -1.14205, 0.790659], [-0.28750700000000001, -0.60358299999999998, -1.03515, -2.5338500000000002, -1.7267600000000001, 0.27448299999999998]]
if len(poses):
    
    # get points from poses
    pts_mtip = [rg.Point3d(p[0], p[1], p[2]) for p in poses]
    
    T_W_R_init_guess = rg.Transform.PlaneToPlane(rg.Plane.WorldXY, RCF_plane_init_guess)
    pts_mtip_init_guess = [ghcomp.Transform(pt, T_W_R_init_guess) for pt in pts_mtip]
    
    # format Rhino transformation
    T_W_R_init_guess_flattened = [float(f) for f in T_W_R_init_guess.ToFloatArray(True)]
    T_W_R_init_guess_list = [T_W_R_init_guess_flattened[i:(i + 4)] for i in range(0, len(T_W_R_init_guess_flattened), 4)]  

    # format ptsA and ptsB
    dataB = [list(pt) for pt in pts_cad]
    dataA = [list(pt) for pt in pts_mtip]
    
    # call the function
    max_iterations = 100
    
    if calc:
        icp_func = Proxy('ur_fabrication_control.optimisation.icp', python = 'C://Users//lidet//anaconda3//envs//urfab//python.exe')
        #icp_func = Proxy('ur_fabrication_control.optimisation.icp', python = 'C://Users//doerf//.conda//envs//rsrd_22//python.exe') #C:\Users\doerf\.conda\envs\rsrd_22
        
        
        print icp_func._python

        transformation, distances = icp_func.icp(dataA, dataB, init_guess=T_W_R_init_guess_list, max_iterations=max_iterations, tolerance=0.000001)
        
        print "distances", distances
        
        # format result
        T = rg.Transform.Identity
        for i in range(4):
            for j in range(4):
                code = "T.M%i%i = %f" % (i, j, transformation[i][j])
                print code
                exec(code)
        #print T
        
        # now transform the points with the transformation calculated
        pts_mtip_fit = [ghcomp.Transform(pt, T) for pt in pts_mtip]
        RCF_plane_fit = ghcomp.Transform(rg.Plane.WorldXY, T)
        RCF_frame_fit = Frame(RCF_plane_fit.Origin, RCF_plane_fit.XAxis, RCF_plane_fit.YAxis)
        
        
        #f = Frame(base_plane_fit)
        #print f.get_pose_quaternion()
        
        # correct the zvalue
        #base_plane_fit = ghcomp.Transform(base_plane_fit, rg.Transform.Translation(0,0,-3))
# ---------- end calc_rcf ----------
pt_3 = Point(calc_rcf.pts_mtip_init_guess)
pt_4 = Point(calc_rcf.pts_mtip_fit)

pln_16 = Plane(calc_rcf.RCF_plane_fit)
