# Grasshopper definition ex1_brickwall.ghx (Grasshopper 1.0.7)
# plug-ins: Weaverbird, FologramForGrasshopper

reload = Button()
py = PythonScript(reload=reload)
# ---------- py: Python ----------
from compas_rhino.utilities.misc import get_tolerance
from compas_ghpython import unload_modules

unload_modules("ur_fabrication_control")
unload_modules("assembly_information_model")
# ---------- end py ----------

py_2 = PythonScript()  # -> HERE, DATA
# ---------- py_2: Python ----------
import os

HERE = os.path.dirname(ghdoc.Path)
DATA = os.path.abspath(os.path.join(HERE, "..", "data"))
print(HERE)
print(DATA)
# ---------- end py_2 ----------

# ----
# Element
# Predefine a brick element and its dimensions
# Visualise the defined element
show = BooleanToggle(False)
elem_def = GhPythonScript()  # -> out, elem_full, elem_half
# ---------- elem_def: Python ----------
import os
import sys
import json

from compas.geometry import Frame
from compas.geometry import Vector
from compas.geometry import Box

from assembly_information_model.assembly import Element


# dimensions full brick
width = 0.115
length = 0.240
height = 0.050

elem_full = Element.from_dimensions(length, width, height)
elem_full.tool_frame = Frame([0, 0, height], [1, 0, 0], [0, -1, 0])

elem_half = Element.from_dimensions(length/2, width, height)
elem_half.tool_frame = Frame([0, 0, height], [1, 0, 0], [0, -1, 0])
# ---------- end elem_def ----------
draw = PythonScript(elem_full=elem_def.elem_full, elem_half=elem_def.elem_half, show=show)  # -> M, F, S
# ---------- draw: Python ----------
from compas.geometry import Transformation
from compas.geometry import Frame
from compas.datastructures import mesh_transformed
from compas_ghpython.artists import MeshArtist
from compas_ghpython import draw_frame

if show:
    artist = MeshArtist(elem_full.mesh)
    M = [artist.draw_mesh()]
    F = [draw_frame(elem_full.frame)]
    #S = [draw_frame(elem_full._source.frame)]
    S = [draw_frame(elem_full.tool_frame)]
    
    
    artist = MeshArtist(elem_half.mesh)
    M += [artist.draw_mesh()]
    F += [draw_frame(elem_half.frame)]
    #S += [draw_frame(elem_half._source.frame)]
    S = [draw_frame(elem_half.tool_frame)]
# ---------- end draw ----------

# ----
# Assembly
pt = Point(<point referenced from the Rhino model>)
brep = Brep(<brep referenced from the Rhino model>)
pt_2 = Point(<point referenced from the Rhino model>)
python = GhPythonScript(brep=brep, pt_base=pt, pt_end=pt_2, bricklen="0.240", interval="0.050")  # -> out, plane_grid, planes; inputs brep: Brep, pt_base: Point3d, pt_end: Point3d
# ---------- python: Python ----------
import Rhino.Geometry as rg
import math as m



def list_from_2darray(array):
    return [item for sublist in array for item in sublist]
    
def create_planegrid(brep, pt_base, pt_end, interval, bricklen):
    """ create diamond plane grid according to even and
    odd rows for a regualr stretcher bond.
    udiv: rows
    vdiv: cols (cols should be an odd number,
    for culling each second col to create even and odd courses)
    """

    curves = rg.Brep.CreateContourCurves(brep, pt_base, pt_end, interval)
    clen = curves[0].GetLength()
    cols = int(clen/(bricklen+0.020))*2
    print cols
    
    plane_grid = []

    for j, c in enumerate(curves):
        row = []
        vparams = rg.Curve.DivideByCount(c, cols, True)
        planes = rg.Curve.GetPerpendicularFrames(c, vparams)
        
        for i, plane in enumerate(planes):

            plane.Rotate(m.radians(90), plane.YAxis)
            #plane.Rotate(m.radians(-90), plane.ZAxis)
            plane.Rotate(m.radians(90), plane.XAxis)

            if j%2 == 0 and i%2 == 0: #even course
                if i==0:
                    plane.Translate(plane.XAxis*-bricklen/4)
                    #plane.Translate(plane.YAxis*-bricklen/6)
                    plane.Rotate(m.radians(90), plane.ZAxis)
                elif i==len(planes)-1:
                    plane.Translate(plane.XAxis*bricklen/4)
                    plane.Translate(plane.YAxis*-bricklen/5)
                    plane.Rotate(m.radians(0), plane.ZAxis)
                row.append(plane)
            if j%2 == 1 and i%2 == 1: #odd course

                row.append(plane)

        plane_grid.append(row)
    return plane_grid

plane_grid = create_planegrid(brep, pt_base, pt_end, interval, bricklen)
planes = list_from_2darray(plane_grid)
# ---------- end python ----------
pln = Plane(python.planes)
number_slider = Slider(40, range=0..100)
generate_assembly = GhPythonScript(rot_factor=number_slider, plane_grid=python.plane_grid, elem_full=elem_def.elem_full, elem_half=elem_def.elem_half)  # -> assembly; inputs rot_factor: Int32, plane_grid: list
# ---------- generate_assembly: Python ----------
import Rhino.Geometry as rg
import math
from scriptcontext import sticky as st


from compas.geometry import Frame
from compas.geometry import Transformation
from compas.geometry import Rotation
from compas.geometry import Translation
from compas.geometry import Point

from compas_ghpython import draw_frame

from assembly_information_model.assembly import Assembly

import Rhino.Geometry as rg


assembly = Assembly() # initialize an empty assembly class


for j, row in enumerate(plane_grid):
    #print row
    for i, plane in enumerate(row):
        #print plane
        rotval1 = math.sin(i/6)*rot_factor
        rotval2 = math.sin(i/6)*(rot_factor)
        print rotval1,rotval2
        new_plane= rg.Plane(plane)
        
        if j%2==0: #even layers
            new_plane.Rotate(-math.radians(rotval1), plane.ZAxis, plane.Origin)
        else:
            new_plane.Rotate(math.radians(rotval2), plane.ZAxis, plane.Origin)
        
        T = Transformation.from_frame_to_frame(Frame.worldXY(), Frame(new_plane.Origin, new_plane.XAxis, new_plane.YAxis))
        
        if j%2==0: #even layers
            if i==0 or i==len(row)-1:
                e = elem_full.transformed(T)
            else:
                e = elem_full.transformed(T)
        else:
            e = elem_full.transformed(T)
        assembly.add_element(e)

"""
if transform:
    T = Transformation.from_frame_to_frame(Frame.worldXY(), Frame(ptransf.Origin, ptransf.XAxis, ptransf.YAxis))
    assembly.transform(T)
"""
# ---------- end generate_assembly ----------

show_2 = BooleanToggle(False)
update_network = PythonScript(DATA=py_2.DATA, compute_interfaces_numpy=show_2, assembly=generate_assembly)  # -> assembly
# ---------- update_network: Python ----------
from assembly_information_model.assembly.courses import assembly_courses, assembly_with_interfaces_courses


if compute_interfaces_numpy:
    import os
    from compas.rpc import Proxy
    from assembly_information_model.assembly import Assembly
    p = Proxy('assembly_information_model.assembly.interfaces_numpy')
    p.stop_server()
    p.start_server()

    filename_before = "brickwall_ex2.json"
    filename_after = "brickwall_interfaces_ex2.json"

    PATH_BEFORE = os.path.join(DATA, filename_before)
    PATH_AFTER = os.path.join(DATA, filename_after)
    
    # the assembly has to be serialized such that it can be called from CPython
    assembly.to_json(PATH_BEFORE)
    
    # call the CPython Function using COMPAS RPC
    p.assembly_interfaces_numpy_fromtojson(PATH_BEFORE, PATH_AFTER, nmax=10, amin = 0.0001)

    assembly = Assembly.from_json(PATH_AFTER)


# now compute the courses
assembly_courses(assembly)

# example test: get the bottom keys
c_min = min(assembly.network.nodes_attribute(name='course'))
#print(c_min)
#keys_on_bottom = list(assembly.network.vertices_where({'course': c_min}))
#print(keys_on_bottom)

# example test: get the top keys
c_max = max(assembly.network.nodes_attribute(name='course'))
#print(c_max)
#keys_on_top = list(assembly.network.vertices_where({'course': c_max}))
#print(keys_on_top)
# ---------- end update_network ----------

# ----
# to JSON
export = Button()
export_2 = Button()
export_3 = PythonScript(DATA=py_2.DATA, assembly=update_network, export_to_json=export, export_to_json_unity=export_2)
# ---------- export_3: Python ----------
import os
from compas.datastructures.mesh import mesh_quads_to_triangles
from compas.datastructures.mesh import mesh_unify_cycles

if export_to_json:
    
    filename = "brickwall_ex1.json"
    PATH = os.path.join(DATA, filename)
    
    # the assembly has to be serialized such that it can be called from CPython
    assembly.to_json(PATH)
    

if export_to_json_unity:
    
    for key, e in assembly.elements():
    
        #convert to trimesh
        mesh_quads_to_triangles(e._mesh, check_angles=False)
        #mesh_unify_cycles(e._mesh)
        #print e._mesh.faces
        #print e._mesh.face_vertices(list(e._mesh.faces())[0])

    filename = "brickwall_ex1_unity.json"
    PATH = os.path.join(DATA, filename)
    assembly.to_json(PATH)
# ---------- end export_3 ----------

reset = Button()
start = Button()
back = Button()
stop = Button()
step = Button()
full = Button()
list = ValueList({"20", "50", "100", "500", "1000", "5000"}, selected="50")

# ----
# Draw
# Visualise the entire assembly and its underlying network topology.
counter = CountThroughList(assembly=update_network, start=start, stop=stop, step=step, step_back=back, reset=reset, full=full, interval=list)  # -> item, counter; inputs start: Boolean, stop: Boolean, step_back: Boolean
# ---------- counter: Python ----------
from scriptcontext import sticky as st
from compas_ghpython import update_component


L = list(assembly.elements())
# store data in component
guid = str(ghenv.Component.InstanceGuid)
counter_key = "counter_" + guid
running_key = "running_" + guid

if counter_key not in st:
    st[counter_key] = 0

if running_key not in st:
    st[running_key] = False
    

if st[running_key]:
    if st[counter_key] < len(L) - 1:
        st[counter_key] += 1
        update_component(ghenv, interval)
    else:
        st[counter_key] = 0
        st[running_key] = False
    
    
if start:
    st[running_key] = True

if stop:
    st[running_key] = False

if step:
    if st[counter_key] < len(L) - 1:
        st[counter_key] += 1

if step_back:
    if st[counter_key] < len(L) - 1:
        st[counter_key] -= 1

if reset:
    st[counter_key] = 0

if full:
    st[counter_key] = len(L)-1

if len(L):
    item = L[st[counter_key]]



#st["visualisation_counter"] = st[counter_key]
#st[counter_key]= 500
counter = st[counter_key]
# ---------- end counter ----------
idx = Panel(counter.counter)

# ---- group: Assembly Artist
show_3 = BooleanToggle(False)
show_4 = BooleanToggle(True)
draw_2 = PythonScript(assembly=update_network, show_all=show_3, show_counter=show_4, counter=counter.counter)  # -> G, tool_planes_WCS, current_tool_plane; inputs counter: Int32
# ---------- draw_2: Python ----------
import os
import sys

import math

from compas_ghpython.artists import MeshArtist
from compas_ghpython import draw_frame


G = []

key_index = assembly.network.key_index()
keys = [key_index[key] for key in assembly.network.nodes()]
elements = [assembly.element(key) for key in keys]
#print elements
#print([(e.gripping_frame) for e in elements])

tool_planes_WCS = [draw_frame(e.tool_frame) for e in elements]

current_tool_plane = tool_planes_WCS[counter]

if show_all and not show_counter:
    for element in elements:
        artist = MeshArtist(element.mesh)
        mesh = artist.draw_mesh()
        G.append(mesh)

if show_counter:
    for element in elements[0:counter+1]:
        artist = MeshArtist(element.mesh)
        mesh = artist.draw_mesh()
        G.append(mesh)
# ---------- end draw_2 ----------
pln_2 = Plane(draw_2.current_tool_plane)
pln_3 = Plane(draw_2.tool_planes_WCS)
geo = Geometry(draw_2.G)
wbtriangles = WeaverbirdsSplitTrianglesSubdivision(MeshCurves=geo, Level=1)
preview = CustomPreview(Geometry=pln_3, Shader=ColourSwatch(SwatchColor=RGB(178, 178, 178)))
preview_2 = CustomPreview(Geometry=wbtriangles, Shader=ColourSwatch(SwatchColor=RGB(255, 255, 255)))

# ----
syncparams = SyncParameters(
    augmented_trigger_1_key=reload,
    augmented_trigger_40_key=show_3,
    augmented_trigger_41_key=show_4,
    augmented_trigger_42_key=start,
    augmented_trigger_43_key=stop,
    augmented_trigger_44_key=step,
    augmented_trigger_45_key=back,
    augmented_trigger_46_key=reset,
    augmented_trigger_47_key=full,
    augmented_trigger_48_key=list,
    augmented_trigger_49_key=show_2,
    augmented_trigger_50_key=show,
    augmented_trigger_51_key=export,
    augmented_trigger_52_key=export_2,
    augmented_trigger_53_key=number_slider,
    componentVersion=1,
    num_augmented_triggers=196)
